# Grasshopper definition pattern1.gh (Grasshopper 0.9.76)

crv = Curve(<curve referenced from the Rhino model>)
crv_2 = Curve(<curve referenced from the Rhino model>)
crv_3 = Curve(<curve referenced from the Rhino model>)
c_script = CSharpScript(x=crv)  # -> out, A; inputs x: Polyline
# ---------- c_script: C# ----------
    List<Vector3d> test = SegmentVector.GetAlign(x, true);
    A = test[3];
# ---------- c_script: C# additional code ----------
  public static Polyline AlignPolyline(Polyline polyline)
  {
    Polyline output = new Polyline(polyline);
    if (output.ToNurbsCurve().ClosedCurveOrientation(Vector3d.ZAxis) == CurveOrientation.CounterClockwise)
    {
      output.Reverse();
    }
    return output;
  }

  public static List<Point3d> GetVertex(Polyline polyline)
  {
    List<Point3d> tempVertex = new List<Point3d>(polyline);
    tempVertex.RemoveAt(tempVertex.Count - 1);

    return tempVertex;
  }

  public static Polyline ToPolyline(Curve curve)
  {
    Polyline output = new Polyline();
    curve.TryGetPolyline(out output);
    return output;
  }

  public static Vector3d RotateVectorXY(Vector3d baseVector, double angle)
  {
    Vector3d rotatedVector = new Vector3d(baseVector.X * Math.Cos(angle) - baseVector.Y * Math.Sin(angle), baseVector.X * Math.Sin(angle) + baseVector.Y * Math.Cos(angle), 0);
    return rotatedVector;
  }

  /// <summary>
  /// 폴리라인의 각 세그먼트들에 대해 평행한 또는 안쪽으로 수직인 벡터 리스트를 구해줍니다.(반시계방향 기준)
  /// </summary>
  public class SegmentVector
  {
    public static List<Vector3d> GetAlign(Polyline polyline, bool unitize)
    {
      Polyline ccwAlign = AlignPolyline(polyline);
      List<Point3d> tempVertex = new List<Point3d>(ccwAlign);
      tempVertex.RemoveAt(tempVertex.Count() - 1);
      List<Vector3d> alignVector = new List<Vector3d>();
      int numVertex = tempVertex.Count;
      for (int i = 0; i < numVertex; i++)
      {
        Point3d tempStart = tempVertex[i];
        Point3d tempEnd = tempVertex[(numVertex + i + 1) % numVertex];
        Vector3d tempVector = new Vector3d(tempEnd - tempStart); // Align Vector with length

        if (unitize)
          tempVector = tempVector / tempVector.Length;

        alignVector.Add(tempVector);
      }
      return alignVector;
    }

    public static List<Vector3d> GetPerpendicular(Polyline polyline, bool unitize)
    {
      Polyline ccwAlign = AlignPolyline(polyline);
      List<Point3d> tempVertex = new List<Point3d>(ccwAlign);
      tempVertex.RemoveAt(tempVertex.Count() - 1);
      List<Vector3d> perpVector = new List<Vector3d>();
      int numVertex = tempVertex.Count;
      for (int i = 0; i < numVertex; i++)
      {
        Point3d tempStart = tempVertex[i];
        Point3d tempEnd = tempVertex[(numVertex + i + 1) % numVertex];
        Vector3d tempVector = new Vector3d(tempEnd - tempStart); // Align Vector with length
        tempVector.Transform(Transform.Rotation(Math.PI / 2, tempStart));

        if (unitize)
          tempVector = tempVector / tempVector.Length;

        perpVector.Add(tempVector);
      }
      return perpVector;
    }
  }
# ---------- end c_script ----------
pattern1 = CSharpScript(
    outline=crv_3,
    coreLine=crv,
    landing=crv_2,
    upstairdir=c_script.A,
    length2=Slider(1, range=0.001..1),
    length3=Slider(0.606, range=0.001..1),
    div1H=Slider(0.366, range=0.001..1),
    div1V=Slider(0.238, range=0.001..1))  # -> out, A, B, C, D; inputs outline: Polyline, coreLine: Polyline, landing: Polyline, upstairdir: Vector3d, length2: Double, length3: Double, div1H: Double, div1V: Double
# ---------- pattern1: C# ----------
    Line baseLine = SearchBaseLine(landing, upstairdir);
    List<Line> mainAxis = SetMainAxis(landing, outline, upstairdir, baseLine, 1);
    Point3d anchor1 = DrawAnchor1(baseLine, mainAxis, 1);
    Point3d anchor2 = DrawAnchor2(anchor1, coreLine, outline, mainAxis, 1, length2);
    Point3d anchor3 = DrawAnchor3(anchor2, outline, mainAxis, 1, length3);

    List<Point3d> anchors = new List<Point3d>();
    anchors.Add(anchor1);
    anchors.Add(anchor2);
    anchors.Add(anchor3);

    Polyline corridor = DrawCorridor(anchors, mainAxis, 1);
    Polyline divider1 = DrawFirstDivider(anchor1, anchor3, outline, mainAxis, div1H, div1V, 1);
    Polyline divider3 = DrawLastDivider(anchor3, anchor1, outline, mainAxis, div1H, 1);

    A = anchors;
    B = divider1;
    C = divider3;
    D = corridor;
# ---------- pattern1: C# additional code ----------
  public Line SearchBaseLine(Polyline landing, Vector3d upstairDirec)
  {
    //output
    Line baseSeg = new Line();

    //process
    List<Line> landingSeg = landing.GetSegments().ToList();
    List<Line> perpToStair = new List<Line>();

    double perpTolerance = 0.005;

    foreach (Line i in landingSeg)
    {
      double axisDecider = Math.Abs(Vector3d.Multiply(i.Direction, upstairDirec));
      if (axisDecider < perpTolerance)
        perpToStair.Add(i);
    }

    perpToStair.Sort(delegate(Line x, Line y)
      {
        Point3d perp1Center = x.PointAt(0.5);
        Point3d perp2Center = y.PointAt(0.5);

        Vector3d gapBetween = perp1Center - perp2Center;
        double decider = Vector3d.Multiply(gapBetween, upstairDirec);

        if (decider > 0)
          return -1;
        else if (decider == 0)
          return 0;
        else
          return 1;
      });

    baseSeg = perpToStair[0];

    return baseSeg;
  }

  public List<Line> SetMainAxis(Polyline landing, Polyline outline, Vector3d upstairDirec, Line baseLine, double scale)
  {
    //output
    List<Line> mainAxis = new List<Line>();

    //process
    Point3d basePt = baseLine.PointAt(0.5) - (upstairDirec / upstairDirec.Length) * (600 / scale);

    //set horizontalAxis, 횡축은 외곽선에서 더 먼 쪽을 선택
    Line horizonReached1 = PCXTools.ExtendFromPt(basePt, outline, baseLine.UnitTangent);
    Line horizonReached2 = PCXTools.ExtendFromPt(basePt, outline, -baseLine.UnitTangent);

    if (horizonReached1.Length > horizonReached2.Length)
      mainAxis.Add(horizonReached1);
    else
      mainAxis.Add(horizonReached2);

    //set verticalAxis, 종축은 외곽선에서 더 가까운 쪽을 선택
    Line verticalReached1 = PCXTools.ExtendFromPt(basePt, outline, upstairDirec);
    Line verticalReached2 = PCXTools.ExtendFromPt(basePt, outline, -upstairDirec);

    if (verticalReached1.Length < verticalReached2.Length)
      mainAxis.Add(verticalReached1);
    else
      mainAxis.Add(verticalReached2);

    return mainAxis;

  }

  public Point3d DrawAnchor1(Line baseLine, List<Line>mainAxis, double scale)
  {
    Point3d anchor = new Point3d();

    Point3d basePt = mainAxis[0].PointAt(0);
    Point3d anchorCenter = basePt + mainAxis[0].UnitTangent * (baseLine.Length / 2.0 + 600 / scale);
    anchor = anchorCenter; //임시

    return anchor;
  }

  public Point3d DrawAnchor2(Point3d anchor1, Polyline coreLine, Polyline outline, List<Line>mainAxis, double scale, double lengthFactor)
  {
    Point3d anchor2 = new Point3d();

    Point3d anchor2Center = new Point3d();
    double anchorLineLength = PCXTools.ExtendFromPt(mainAxis[1].PointAt(0), coreLine, mainAxis[1].UnitTangent).Length;

    if (anchorLineLength < mainAxis[1].Length)
      anchor2Center = anchor1 + mainAxis[1].UnitTangent * (anchorLineLength - 600 / scale) * lengthFactor;
    else
      anchor2Center = anchor1 + mainAxis[1].UnitTangent * (mainAxis[1].Length - 600 / scale) * lengthFactor;

    anchor2 = anchor2Center; //임시

    return anchor2;
  }

  public Point3d DrawAnchor3(Point3d anchor2, Polyline outline, List<Line>mainAxis, double scale, double lengthFactor)
  {
    Point3d anchor3 = new Point3d();

    Point3d anchor3Center = new Point3d();
    double anchorLineLength = (PCXTools.ExtendFromPt(anchor2, outline, mainAxis[0].UnitTangent).Length - 600 / scale) * lengthFactor;
    anchor3Center = anchor2 + mainAxis[0].UnitTangent * anchorLineLength;

    anchor3 = anchor3Center; //임시
    return anchor3;
  }

  public Polyline DrawCorridor(List<Point3d> anchors, List<Line> mainAxis, double scale)
  {
    Polyline corridor = new Polyline();

    if (anchors.Count < 2)
      return null;

    List<Rectangle3d> rectList = new List<Rectangle3d>();

    for(int i = 0; i < anchors.Count - 1;i++)
    {
      Rectangle3d tempRect = RectangleTools.DrawP2PRect(anchors[i], anchors[i + 1], 1200 / scale);
      rectList.Add(tempRect);
    }

    if(rectList.Count > 1)
    {
      Curve intersected = rectList[0].ToNurbsCurve();

      for(int i = 0; i < rectList.Count - 1;i++)
      {
        List<Curve> unionCurves = new List<Curve>();
        unionCurves.Add(intersected);
        unionCurves.Add(rectList[i + 1].ToNurbsCurve());
        intersected = Curve.CreateBooleanUnion(unionCurves)[0];
      }

      corridor = CurveTools.ToPolyline(intersected);
    }

    return corridor;
  }

  public Polyline DrawFirstDivider(Point3d anchor1, Point3d hLimitPt, Polyline outline, List<Line> mainAxis, double hFactor, double vFactor, double scale)
  {
    Polyline firstDivider = new Polyline();

    Plane basePln = new Plane(anchor1, mainAxis[0].UnitTangent, -mainAxis[1].UnitTangent);
    Point3d anchor1Copy = new Point3d(anchor1) + basePln.XAxis * 600 / scale + basePln.YAxis * 600 / scale;
    Point3d limitPtCopy = new Point3d(hLimitPt);
    Polyline outlineCopy = new Polyline(outline);

    //transform coordinate
    outlineCopy.Transform(Transform.ChangeBasis(Plane.WorldXY, basePln));
    anchor1Copy.Transform(Transform.ChangeBasis(Plane.WorldXY, basePln));
    limitPtCopy.Transform(Transform.ChangeBasis(Plane.WorldXY, basePln));

    //set horizontal limit
    double hLimit = new double();
    hLimit = limitPtCopy.X - anchor1Copy.X;

    //set negative vertical limit //temp
    double vLimitBelow = new double();
    vLimitBelow = anchor1Copy.Y - hLimitPt.Y;

    //set positive vertical limit
    double vLimit = new double();

    Point3d newAnchor1 = anchor1Copy + Vector3d.XAxis * hLimit * hFactor;

    Line limitDecider1 = PCXTools.ExtendFromPt(anchor1Copy, outlineCopy, Vector3d.YAxis);
    Line limitDecider2 = PCXTools.ExtendFromPt(newAnchor1, outlineCopy, Vector3d.YAxis);

    List<Point3d> vLimitCandidate = new List<Point3d>();
    List<Point3d> vLimitRunner = PolylineTools.GetVertex(outlineCopy);

    vLimitCandidate.Add(limitDecider1.PointAt(1));
    vLimitCandidate.Add(limitDecider2.PointAt(1));
    vLimitCandidate.Sort((x, y) => x.X.CompareTo(y.X));

    foreach (Point3d i in vLimitRunner)
    {
      if ((i.X > vLimitCandidate[0].X) && (i.X < vLimitCandidate[1].X) && (i.Y > anchor1Copy.Y))
        vLimitCandidate.Add(i);
    }

    vLimitCandidate.Sort((x, y) => x.Y.CompareTo(y.Y));
    vLimit = vLimitCandidate[0].Y - anchor1Copy.Y;

    //draw new anchor and dividing line
    List<Point3d> dividingVertex = new List<Point3d>();
    anchor1Copy.Transform(Transform.ChangeBasis(basePln, Plane.WorldXY));
    limitDecider2.Transform(Transform.ChangeBasis(basePln, Plane.WorldXY));

    Point3d firstAnchor1 = anchor1Copy + basePln.YAxis * vLimit * vFactor;
    Point3d firstAnchor2 = anchor1Copy + basePln.XAxis * hLimit * hFactor + basePln.YAxis * vLimit * vFactor;



    dividingVertex.Add(anchor1Copy);
    dividingVertex.Add(firstAnchor1);
    dividingVertex.Add(firstAnchor2);
    dividingVertex.Add(limitDecider2.PointAt(1));

    firstDivider = new Polyline(dividingVertex);

    return firstDivider;
  }

  public Polyline DrawLastDivider(Point3d anchor3, Point3d hLimitPt, Polyline outline, List<Line> mainAxis, double hFactor, double scale)
  {
    Polyline lastDivider = new Polyline();

    Plane basePln = new Plane(anchor3, mainAxis[0].UnitTangent, -mainAxis[1].UnitTangent);
    Point3d anchor3Copy = new Point3d(anchor3) + basePln.XAxis * 600 / scale + basePln.YAxis * 600 / scale;
    //transform coordinate

    //check horizontal limit

    //set vertical limit

    //draw new anchor and dividing line
    Line lastLine = PCXTools.ExtendFromPt(anchor3Copy, outline, basePln.YAxis);

    List<Point3d> test = new List<Point3d>();
    test.Add(anchor3Copy);
    test.Add(lastLine.PointAt(1));

    lastDivider = new Polyline(test);
    return lastDivider;
  }

  class PCXTools
  {
    public static Line ExtendFromPt(Point3d basePt, Polyline boundary, Vector3d direction)
    {
      Line output = new Line();

      double coverAllLength = new BoundingBox(boundary).Diagonal.Length * 2;
      LineCurve lay = new LineCurve(basePt, basePt + direction / direction.Length * coverAllLength);

      var layIntersection = Rhino.Geometry.Intersect.Intersection.CurveCurve(lay, boundary.ToNurbsCurve(), 0, 0);

      List<Point3d> intersectedPts = new List<Point3d>();
      foreach (var i in layIntersection)
        intersectedPts.Add(i.PointA);

      intersectedPts.Sort((x, y) => basePt.DistanceTo(x).CompareTo(basePt.DistanceTo(y)));
      output = new Line(basePt, intersectedPts[0]);

      return output;
    }
  }

  class PolylineTools
  {
    public static List<Point3d> GetVertex(Polyline polyline)
    {
      List<Point3d> tempVertex = new List<Point3d>(polyline);
      tempVertex.RemoveAt(tempVertex.Count - 1);

      return tempVertex;
    }
  }

  class RectangleTools
  {
    public static Rectangle3d DrawP2PRect(Point3d pointStart, Point3d pointEnd, double thickness)
    {
      Rectangle3d p2pRect = new Rectangle3d();

      Vector3d alignP2P = new Line(pointStart, pointEnd).UnitTangent;
      Vector3d perpP2P = VectorTools.RotateVectorXY(alignP2P, Math.PI / 2);

      Point3d corner1 = pointStart - alignP2P * thickness / 2 + perpP2P * thickness / 2;
      Point3d corner2 = pointEnd + alignP2P * thickness / 2 - perpP2P * thickness / 2;
      Plane p2pPlane = new Plane(pointStart, alignP2P, perpP2P);

      p2pRect = new Rectangle3d(p2pPlane, corner1, corner2);

      return p2pRect;
    }
  }

  class VectorTools
  {
    public static Vector3d RotateVectorXY(Vector3d baseVector, double angle)
    {
      Vector3d rotatedVector = new Vector3d(baseVector.X * Math.Cos(angle) - baseVector.Y * Math.Sin(angle), baseVector.X * Math.Sin(angle) + baseVector.Y * Math.Cos(angle), 0);
      return rotatedVector;
    }
  }

  class CurveTools
  {
    public static double GetArea(Curve input)
    {
      Polyline plotPolyline;
      input.TryGetPolyline(out plotPolyline);

      List<Point3d> y = new List<Point3d>(plotPolyline);
      double area = 0;

      for (int i = 0; i < y.Count - 1; i++)
      {
        area += y[i].X * y[i + 1].Y;
        area -= y[i].Y * y[i + 1].X;
      }

      area /= 2;
      return (area < 0 ? -area : area);
    }

    public static Polyline ToPolyline(Curve curve)
    {
      Polyline output = new Polyline();
      curve.TryGetPolyline(out output);
      return output;
    }

  }
# ---------- end pattern1 ----------
panel = Panel(pattern1.out)
pt = Point(pattern1.A)
crv_4 = Curve(pattern1.D)
crv_5 = Curve([pattern1.B, pattern1.C])
yellow = ColourRGB(Alpha=255, Red=207, Green=211, Blue=49)
azure = ColourRGB(Alpha=255, Red=67, Green=156, Blue=210)
coral = ColourRGB(Alpha=255, Red=176, Green=52, Blue=49)
preview = CustomPreview(Geometry=crv_4, Shader=azure)
preview_2 = CustomPreview(Geometry=crv_5, Shader=yellow)
preview_3 = CustomPreview(Geometry=pt, Shader=coral)

crv_6 = Curve(<curve referenced from the Rhino model>)
crv_7 = Curve(<curve referenced from the Rhino model>)
crv_8 = Curve(<curve referenced from the Rhino model>)
crv_9 = Curve(<curve referenced from the Rhino model>)
crv_10 = Curve(<curve referenced from the Rhino model>)
crv_11 = Curve(<curve referenced from the Rhino model>)
c_script_2 = CSharpScript(x=crv_6)  # -> out, A; inputs x: Polyline; same code as c_script
c_script_3 = CSharpScript(x=crv_9)  # -> out, A; inputs x: Polyline
# ---------- c_script_3: C# ----------
    List<Vector3d> test = SegmentVector.GetAlign(x, true);

    A = test[1];
# ---------- c_script_3: C# additional code ----------
  public static Polyline AlignPolyline(Polyline polyline)
  {
    Polyline output = new Polyline(polyline);
    if (output.ToNurbsCurve().ClosedCurveOrientation(Vector3d.ZAxis) == CurveOrientation.CounterClockwise)
    {
      output.Reverse();
    }
    return output;
  }

  public static List<Point3d> GetVertex(Polyline polyline)
  {
    List<Point3d> tempVertex = new List<Point3d>(polyline);
    tempVertex.RemoveAt(tempVertex.Count - 1);

    return tempVertex;
  }

  public static Polyline ToPolyline(Curve curve)
  {
    Polyline output = new Polyline();
    curve.TryGetPolyline(out output);
    return output;
  }

  public static Vector3d RotateVectorXY(Vector3d baseVector, double angle)
  {
    Vector3d rotatedVector = new Vector3d(baseVector.X * Math.Cos(angle) - baseVector.Y * Math.Sin(angle), baseVector.X * Math.Sin(angle) + baseVector.Y * Math.Cos(angle), 0);
    return rotatedVector;
  }

  /// <summary>
  /// 폴리라인의 각 세그먼트들에 대해 평행한 또는 안쪽으로 수직인 벡터 리스트를 구해줍니다.(반시계방향 기준)
  /// </summary>
  public class SegmentVector
  {
    public static List<Vector3d> GetAlign(Polyline polyline, bool unitize)
    {
      Polyline ccwAlign = AlignPolyline(polyline);
      List<Point3d> tempVertex = new List<Point3d>(ccwAlign);
      tempVertex.RemoveAt(tempVertex.Count() - 1);
      List<Vector3d> alignVector = new List<Vector3d>();
      int numVertex = tempVertex.Count;
      for (int i = 0; i < numVertex; i++)
      {
        Point3d tempStart = tempVertex[i];
        Point3d tempEnd = tempVertex[(numVertex + i + 1) % numVertex];
        Vector3d tempVector = new Vector3d(tempEnd - tempStart); // Align Vector with length

        if (unitize)
          tempVector = tempVector / tempVector.Length;

        alignVector.Add(tempVector);
      }
      return alignVector;
    }

    public static List<Vector3d> GetPerpendicular(Polyline polyline, bool unitize)
    {
      Polyline ccwAlign = AlignPolyline(polyline);
      List<Point3d> tempVertex = new List<Point3d>(ccwAlign);
      tempVertex.RemoveAt(tempVertex.Count() - 1);
      List<Vector3d> perpVector = new List<Vector3d>();
      int numVertex = tempVertex.Count;
      for (int i = 0; i < numVertex; i++)
      {
        Point3d tempStart = tempVertex[i];
        Point3d tempEnd = tempVertex[(numVertex + i + 1) % numVertex];
        Vector3d tempVector = new Vector3d(tempEnd - tempStart); // Align Vector with length
        tempVector.Transform(Transform.Rotation(Math.PI / 2, tempStart));

        if (unitize)
          tempVector = tempVector / tempVector.Length;

        perpVector.Add(tempVector);
      }
      return perpVector;
    }
  }
# ---------- end c_script_3 ----------
crv_12 = Curve(<curve referenced from the Rhino model>)
crv_13 = Curve(<curve referenced from the Rhino model>)
crv_14 = Curve(<curve referenced from the Rhino model>)
pattern1_2 = CSharpScript(
    outline=crv_10,
    coreLine=crv_9,
    landing=crv_11,
    upstairdir=c_script_3.A,
    x=Slider(1, range=0.001..1),
    y=Slider(1, range=0.001..1),
    numOfRoom=Slider(6, range=0..6),
    seed=Slider(35, range=0..100))  # -> out, A, B, E; inputs outline: Polyline, coreLine: Polyline, landing: Polyline, upstairdir: Vector3d, x: Double, y: Double, numOfRoom: Int32, seed: Int32, factorList: list of Double
# ---------- pattern1_2: C# ----------
    Core core = new Core(coreLine, landing, upstairdir);
    List < double > anchorFactors = new List<double>{x,y};
    List<double> dividerFactors = MakeRandomFactor(numOfRoom, seed);
    List<double> diff = new List<double>();


    Polyline corridor = new Polyline();
    List<Polyline> dividers = DrawDividers(core, outline, numOfRoom, anchorFactors, dividerFactors, out corridor, out diff);

    List<double> diffdiff = new List<double>();

    if(diff.Count > 1)
    {
      for(int i = 0; i < diff.Count - 1; i++)
      {
        diffdiff.Add(Math.Abs(diff[i + 1] - diff[i]));
      }
    }

    double sumdd = NumberTools.SumDouble(diffdiff);

    A = dividers;
    B = corridor;
    E = sumdd;
# ---------- pattern1_2: C# additional code ----------
  public List<Polyline> DrawDividers(Core core, Polyline outline, double numOfRoom, List<double> anchorFactors, List<double> dividerFactors, out Polyline cor, out List<double> diff)
  {
    //
    Line baseLine = SearchBaseLine(core);
    List<Line> baseAxis = SetBaseAxis(outline, core, baseLine);

    //
    List<Point3d> anchors = new List<Point3d>();
    Point3d anchor1 = DrawAnchor1(baseLine, baseAxis);
    Point3d anchor2 = DrawAnchor2(anchor1, core, outline, baseAxis, anchorFactors[0]);
    Point3d anchor3 = DrawAnchor3(anchor2, outline, baseAxis, anchorFactors[1]);

    anchors.Add(anchor1);
    anchors.Add(anchor2);
    anchors.Add(anchor3);

    //
    Polyline corridor = DrawCorridor(anchors, baseAxis);
    cor = corridor;
    //
    List<Polyline> dividers = new List<Polyline>();
    List<double> divxDiff = new List<double>();

    if (numOfRoom < 2)
    {
      diff = divxDiff;
      return null;
    }
    else
    {
      Point3d nextLimit = new Point3d();
      for (int i = 1; i < numOfRoom; i++)
      {
        Polyline tempDivider = new Polyline();
        double tempFactor = dividerFactors[i];
        Point3d tempLimit = new Point3d();

        if ((tempFactor > 1) || (tempFactor < 0))
          break;

        if (i == 1)
          tempDivider = DrawFirstDivider(anchor1, anchor3, outline, baseAxis, dividerFactors[0], dividerFactors[1], out tempLimit);
        else if (tempFactor < 1)
          tempDivider = DrawMidDivider(nextLimit, anchor3, outline, baseAxis, tempFactor, out tempLimit);
        else
        {
          tempDivider = DrawMidDivider(nextLimit, anchor3, outline, baseAxis, tempFactor, out tempLimit);
          dividers.Add(tempDivider);
          break;
        }

        if(i == 1)
        {
          Point3d firstPt = PCXTools.ExtendFromPt(anchor1, outline, -baseAxis[0].UnitTangent).PointAt(1);
          divxDiff.Add(tempLimit.X - firstPt.X);
        }
        if(i != 1)
          divxDiff.Add(tempLimit.X - nextLimit.X);
        if(i == numOfRoom - 1)
          divxDiff.Add(anchor3.X - tempLimit.X);

        dividers.Add(tempDivider);

        nextLimit = tempLimit;
      }
    }

    diff = divxDiff;
    return dividers;
  }

  public Line SearchBaseLine(Core core)
  {
    //output
    Line baseSeg = new Line();

    //process
    List<Line> landingSeg = core.Landing.GetSegments().ToList();
    List<Line> perpToStair = new List<Line>();

    double perpTolerance = 0.005;

    foreach (Line i in landingSeg)
    {
      double axisDecider = Math.Abs(Vector3d.Multiply(i.UnitTangent, core.UpstairDirec));
      if (axisDecider < perpTolerance)
        perpToStair.Add(i);
    }

    perpToStair.Sort(delegate (Line x, Line y)
      {
        Point3d perp1Center = x.PointAt(0.5);
        Point3d perp2Center = y.PointAt(0.5);

        Vector3d gapBetween = perp1Center - perp2Center;
        double decider = Vector3d.Multiply(gapBetween, core.UpstairDirec);

        if (decider > 0)
          return -1;
        else if (decider == 0)
          return 0;
        else
          return 1;
      });

    baseSeg = perpToStair[0];

    return baseSeg;
  }

  public double SetBasePtVLimit(Core core, Line baseLine)
  {
    double vLimit = 0;

    Point3d decidingPt1 = baseLine.PointAt(0.01) - core.UpstairDirec / core.UpstairDirec.Length * 0.01;
    Point3d decidingPt2 = baseLine.PointAt(0.09) - core.UpstairDirec / core.UpstairDirec.Length * 0.01;

    double candidate1 = PCXTools.ExtendFromPt(decidingPt1, core.Landing, -core.UpstairDirec).Length + 0.01;
    double candidate2 = PCXTools.ExtendFromPt(decidingPt2, core.Landing, -core.UpstairDirec).Length + 0.01;

    if (candidate1 > candidate2)
      vLimit = candidate2;
    else
      vLimit = candidate1;

    return vLimit;
  }

  public List<Line> SetBaseAxis(Polyline outline, Core core, Line baseLine)
  {
    //output
    List<Line> mainAxis = new List<Line>();

    //process
    double basePtY = SetBasePtVLimit(core, baseLine);
    Point3d basePt = baseLine.PointAt(0.5) - (core.UpstairDirec / core.UpstairDirec.Length) * SetBasePtVLimit(core, baseLine) / 2;

    //set horizontalAxis, 횡축은 외곽선에서 더 먼 쪽을 선택
    Line horizonReached1 = PCXTools.ExtendFromPt(basePt, outline, baseLine.UnitTangent);
    Line horizonReached2 = PCXTools.ExtendFromPt(basePt, outline, -baseLine.UnitTangent);

    if (horizonReached1.Length > horizonReached2.Length)
      mainAxis.Add(horizonReached1);
    else
      mainAxis.Add(horizonReached2);

    //set verticalAxis, 종축은 외곽선에서 더 가까운 쪽을 선택
    Line verticalReached1 = PCXTools.ExtendFromPt(basePt, outline, core.UpstairDirec);
    Line verticalReached2 = PCXTools.ExtendFromPt(basePt, outline, -core.UpstairDirec);

    if (verticalReached1.Length < verticalReached2.Length)
      mainAxis.Add(verticalReached1);
    else
      mainAxis.Add(verticalReached2);

    return mainAxis;

  }

  public Point3d DrawAnchor1(Line baseLine, List<Line>mainAxis) // baseBox 중심에 맞춰져 있음.. 끝으로 바꿔야함
  {
    Point3d anchor = new Point3d();

    Point3d basePt = mainAxis[0].PointAt(0);
    Point3d anchorCenter = basePt + mainAxis[0].UnitTangent * (baseLine.Length / 2.0 + Corridor.OneWayWidth / 2);
    anchor = anchorCenter; //임시

    return anchor;
  }

  public Point3d DrawAnchor2(Point3d anchor1, Core core, Polyline outline, List<Line>mainAxis, double lengthFactor)
  {
    Point3d anchor2 = new Point3d();

    Point3d anchor2Center = new Point3d();
    double anchorLineLength = PCXTools.ExtendFromPt(mainAxis[1].PointAt(0), core.CoreLine, mainAxis[1].UnitTangent).Length;

    if (anchorLineLength < mainAxis[1].Length)
      anchor2Center = anchor1 + mainAxis[1].UnitTangent * (anchorLineLength - Corridor.OneWayWidth / 2) * lengthFactor;
    else
      anchor2Center = anchor1 + mainAxis[1].UnitTangent * (mainAxis[1].Length - Corridor.OneWayWidth / 2) * lengthFactor;

    anchor2 = anchor2Center; //임시

    return anchor2;
  }

  public Point3d DrawAnchor3(Point3d anchor2, Polyline outline, List<Line>mainAxis, double lengthFactor)
  {
    Point3d anchor3 = new Point3d();

    Point3d anchor3Center = new Point3d();
    double anchorLineLength = (PCXTools.ExtendFromPt(anchor2, outline, mainAxis[0].UnitTangent).Length - Corridor.OneWayWidth / 2) * lengthFactor;
    anchor3Center = anchor2 + mainAxis[0].UnitTangent * anchorLineLength;

    anchor3 = anchor3Center; //임시
    return anchor3;
  }

  public Polyline DrawCorridor(List<Point3d> anchors, List<Line> mainAxis)
  {
    Polyline corridor = new Polyline();

    if (anchors.Count < 2)
      return null;

    List<Rectangle3d> rectList = new List<Rectangle3d>();

    for(int i = 0; i < anchors.Count - 1;i++)
    {
      Rectangle3d tempRect = RectangleTools.DrawP2PRect(anchors[i], anchors[i + 1], Corridor.OneWayWidth);
      rectList.Add(tempRect);
    }

    if(rectList.Count > 1)
    {
      Curve intersected = rectList[0].ToNurbsCurve();

      for(int i = 0; i < rectList.Count - 1;i++)
      {
        List<Curve> unionCurves = new List<Curve>();
        unionCurves.Add(intersected);
        unionCurves.Add(rectList[i + 1].ToNurbsCurve());
        intersected = Curve.CreateBooleanUnion(unionCurves)[0];
      }

      corridor = CurveTools.ToPolyline(intersected);
    }

    return corridor;
  }

  public Polyline DrawFirstDivider(Point3d anchor1, Point3d hLimitPt, Polyline outline, List<Line> mainAxis, double hFactor, double vFactor, out Point3d nextLimit)
  {
    Polyline firstDivider = new Polyline();

    Plane basePln = new Plane(anchor1, mainAxis[0].UnitTangent, -mainAxis[1].UnitTangent);
    Point3d anchor1Copy = new Point3d(anchor1) + basePln.XAxis * Corridor.OneWayWidth / 2 + basePln.YAxis * Corridor.OneWayWidth / 2;
    Point3d limitPtCopy = new Point3d(hLimitPt);
    Polyline outlineCopy = new Polyline(outline);

    //transform coordinate
    outlineCopy.Transform(Transform.ChangeBasis(Plane.WorldXY, basePln));
    anchor1Copy.Transform(Transform.ChangeBasis(Plane.WorldXY, basePln));
    limitPtCopy.Transform(Transform.ChangeBasis(Plane.WorldXY, basePln));

    //set horizontal limit
    double hLimit = new double();
    hLimit = limitPtCopy.X - anchor1Copy.X;

    //set negative vertical limit //추가?
    double vLimitBelow = new double();
    vLimitBelow = anchor1Copy.Y - hLimitPt.Y;

    //set positive vertical limit
    double vLimit = new double();

    Point3d newAnchor1 = anchor1Copy + Vector3d.XAxis * hLimit * hFactor;

    Line limitDecider1 = PCXTools.ExtendFromPt(anchor1Copy, outlineCopy, Vector3d.YAxis);
    Line limitDecider2 = PCXTools.ExtendFromPt(newAnchor1, outlineCopy, Vector3d.YAxis);

    List<Point3d> vLimitCandidate = new List<Point3d>();
    List<Point3d> vLimitRunner = PolylineTools.GetVertex(outlineCopy);

    vLimitCandidate.Add(limitDecider1.PointAt(1));
    vLimitCandidate.Add(limitDecider2.PointAt(1));
    vLimitCandidate.Sort((x, y) => x.X.CompareTo(y.X));

    foreach (Point3d i in vLimitRunner)
    {
      if ((i.X > vLimitCandidate[0].X) && (i.X < vLimitCandidate[1].X) && (i.Y > anchor1Copy.Y))
        vLimitCandidate.Add(i);
    }

    vLimitCandidate.Sort((x, y) => x.Y.CompareTo(y.Y));
    vLimit = vLimitCandidate[0].Y - anchor1Copy.Y;

    //draw new anchor and dividing line
    List<Point3d> dividingVertex = new List<Point3d>();
    anchor1Copy.Transform(Transform.ChangeBasis(basePln, Plane.WorldXY));
    limitDecider2.Transform(Transform.ChangeBasis(basePln, Plane.WorldXY));

    Point3d firstAnchor1 = anchor1Copy + basePln.YAxis * vLimit * vFactor;
    Point3d firstAnchor2 = anchor1Copy + basePln.XAxis * hLimit * hFactor + basePln.YAxis * vLimit * vFactor;

    dividingVertex.Add(anchor1Copy);
    dividingVertex.Add(firstAnchor1);
    dividingVertex.Add(firstAnchor2);//중복 판정 넣어야함..
    dividingVertex.Add(limitDecider2.PointAt(1));

    firstDivider = new Polyline(dividingVertex);

    nextLimit = firstAnchor2;
    return firstDivider;
  }

  public Polyline DrawMidDivider(Point3d startLimit, Point3d anchor3, Polyline outline, List<Line> baseAxis, double hFactor, out Point3d nextLimit)
  {
    /*output*/
    Polyline midDivider = new Polyline();

    /*process*/
    Plane basePlane = new Plane(startLimit, baseAxis[0].UnitTangent, -baseAxis[1].UnitTangent);

    //change coordinate
    Point3d ccLimit = PointTools.ChangeCoordinate(startLimit, Plane.WorldXY, basePlane);
    Point3d ccAnchor3 = PointTools.ChangeCoordinate(anchor3, Plane.WorldXY, basePlane) + Vector3d.XAxis * Corridor.OneWayWidth / 2 + Vector3d.YAxis * Corridor.OneWayWidth / 2;

    //set horizontal limit
    double hLimit = ccAnchor3.X - ccLimit.X;

    //draw new anchor and divider
    Point3d ccDividingAnchor = ccLimit - Vector3d.YAxis * ( ccLimit.Y - ccAnchor3.Y);
    Point3d dividingAnchor = PointTools.ChangeCoordinate(ccDividingAnchor, basePlane, Plane.WorldXY) + basePlane.XAxis * (hLimit * hFactor);
    Line divider = PCXTools.ExtendFromPt(dividingAnchor, outline, basePlane.YAxis);

    List<Point3d> dividerVertex = new List<Point3d>();
    dividerVertex.Add(divider.PointAt(0));
    dividerVertex.Add(divider.PointAt(1));

    nextLimit = dividingAnchor;
    midDivider = new Polyline(dividerVertex);

    return midDivider;
  }

  //Fake Tools
  public static List<double> MakeRandomFactor(int numOfRoom, int seed)
  {
    List<double> randomFactors = new List<double>();

    for(int i = 0;i < numOfRoom + 1;i++)
    {
      Random rand1 = new Random(seed + 3 * i);
      double tempFactor = rand1.NextDouble();
      if (tempFactor < 0.001)
        tempFactor = 0.001;

      double adjustedFactor = tempFactor / Math.Pow(1.2, numOfRoom + 1 - i);

      randomFactors.Add(adjustedFactor);
    }

    return randomFactors;
  }

  //Common Data Class//
  public class Core
  {
    //constructor
    public Core(Polyline coreLine, Polyline landing, Vector3d upstairDirec)
    {
      CoreLine = coreLine;
      Landing = landing;
      UpstairDirec = upstairDirec;
    }

    //property
    public Polyline CoreLine { get; private set; }
    public Polyline Landing { get; private set; }
    public Vector3d UpstairDirec{ get; private set; }
  }

  class Corridor
  {
    //field
    private static double scale = 1;
    private static double oneWayCorridorWidth = 1200;
    private static double twoWayCorridorWidth = 1800;
    private static double minRoomWidth = 3000;

    //method

    //property
    public static double MinRoomWidth { get { return minRoomWidth / scale; } private set { } }
    public static double OneWayWidth { get { return oneWayCorridorWidth / scale; } private set { } }
    public static double TwoWayWidth { get { return twoWayCorridorWidth / scale; } private set { } }
  }


  //Tool Class//
  class PCXTools
  {
    public static Line ExtendFromPt(Point3d basePt, Polyline boundary, Vector3d direction)
    {
      Line output = new Line();

      double coverAllLength = new BoundingBox(boundary).Diagonal.Length * 2;
      LineCurve lay = new LineCurve(basePt, basePt + direction / direction.Length * coverAllLength);

      var layIntersection = Rhino.Geometry.Intersect.Intersection.CurveCurve(lay, boundary.ToNurbsCurve(), 0, 0);

      List<Point3d> intersectedPts = new List<Point3d>();
      foreach (var i in layIntersection)
        intersectedPts.Add(i.PointA);

      intersectedPts.Sort((x, y) => basePt.DistanceTo(x).CompareTo(basePt.DistanceTo(y)));
      output = new Line(basePt, intersectedPts[0]);

      return output;
    }
  }

  class PolylineTools
  {
    public static List<Point3d> GetVertex(Polyline polyline)
    {
      List<Point3d> tempVertex = new List<Point3d>(polyline);
      tempVertex.RemoveAt(tempVertex.Count - 1);

      return tempVertex;
    }

    public static Polyline ChangeCoordinate(Polyline basePoly, Plane fromPln, Plane toPln)
    {
      Polyline changedPoly = new Polyline(basePoly);
      changedPoly.Transform(Transform.ChangeBasis(fromPln, toPln));

      return changedPoly;
    }
  }

  class PointTools
  {
    public static Point3d ChangeCoordinate(Point3d basePt, Plane fromPln, Plane toPln)
    {
      Point3d changedPt = basePt;
      changedPt.Transform(Transform.ChangeBasis(fromPln, toPln));

      return changedPt;
    }
  }

  class RectangleTools
  {
    public static Rectangle3d DrawP2PRect(Point3d pointStart, Point3d pointEnd, double thickness)
    {
      Rectangle3d p2pRect = new Rectangle3d();

      Vector3d alignP2P = new Line(pointStart, pointEnd).UnitTangent;
      Vector3d perpP2P = VectorTools.RotateVectorXY(alignP2P, Math.PI / 2);

      Point3d corner1 = pointStart - alignP2P * thickness / 2 + perpP2P * thickness / 2;
      Point3d corner2 = pointEnd + alignP2P * thickness / 2 - perpP2P * thickness / 2;
      Plane p2pPlane = new Plane(pointStart, alignP2P, perpP2P);

      p2pRect = new Rectangle3d(p2pPlane, corner1, corner2);

      return p2pRect;
    }
  }

  class VectorTools
  {
    public static Vector3d RotateVectorXY(Vector3d baseVector, double angle)
    {
      Vector3d rotatedVector = new Vector3d(baseVector.X * Math.Cos(angle) - baseVector.Y * Math.Sin(angle), baseVector.X * Math.Sin(angle) + baseVector.Y * Math.Cos(angle), 0);
      return rotatedVector;
    }
  }

  class CurveTools
  {
    public static double GetArea(Curve input)
    {
      Polyline plotPolyline;
      input.TryGetPolyline(out plotPolyline);

      List<Point3d> y = new List<Point3d>(plotPolyline);
      double area = 0;

      for (int i = 0; i < y.Count - 1; i++)
      {
        area += y[i].X * y[i + 1].Y;
        area -= y[i].Y * y[i + 1].X;
      }

      area /= 2;
      return (area < 0 ? -area : area);
    }

    public static Polyline ToPolyline(Curve curve)
    {
      Polyline output = new Polyline();
      curve.TryGetPolyline(out output);
      return output;
    }

  }

  class NumberTools
  {
    public static double SumDouble(List<double> doubleList)
    {
      double result = new double();

      foreach (double i in doubleList)
        result += i;

      return result;
    }

    /// <summary>
    /// 리스트 전체 합에 대한 각 요소들의 비율을 구해줍니다.
    /// </summary>
    public static List<double> GetPropotion(List<double> doubleList, int decimals)
    {
      List<double> proportions = new List<double>();

      double sum = SumDouble(doubleList);
      foreach (double i in doubleList)
        proportions.Add(Math.Round((i / sum) * 100, decimals));

      return proportions;
    }
  }
# ---------- end pattern1_2 ----------
pattern2 = CSharpScript(
    outline=crv_7,
    coreLine=crv_6,
    landing=crv_8,
    upstairdir=c_script_2.A,
    a3HFactor=Slider(1, range=0.001..1),
    a4VFactor=Slider(0.566, range=0.001..1))  # -> out, A, B, C, D, E; inputs outline: Polyline, coreLine: Polyline, landing: Polyline, upstairdir: Vector3d, a3HFactor: Double, a4VFactor: Double
# ---------- pattern2: C# ----------
    Line baseLine = SearchBaseLine(landing, upstairdir);
    List<Line> baseAxis = SetBaseAxis(landing, outline, upstairdir, baseLine);
    Point3d anchor1 = DrawAnchor1(upstairdir, baseLine, baseAxis, 1200, 1);
    Point3d anchor2 = DrawAnchor2(anchor1, coreLine, baseAxis, 1200, 1);
    Point3d anchor3 = DrawAnchor3(anchor2, outline, baseAxis, baseLine, a3HFactor, 1200, 1);
    Point3d anchor4 = DrawAnchor4(anchor3, outline, baseAxis, a4VFactor, 1200, 1);

    List<Point3d> anchors = new List<Point3d>();
    anchors.Add(anchor1);
    anchors.Add(anchor2);
    anchors.Add(anchor3);
    anchors.Add(anchor4);

    Polyline corridor = DrawCorridor(anchors, baseAxis, 1200, 1);

    A = anchor1;
    B = anchor2;
    C = anchor3;
    D = anchor4;
    E = corridor;
# ---------- pattern2: C# additional code ----------
  public Line SearchBaseLine(Polyline landing, Vector3d upstairDirec)
  {
    //output
    Line baseSeg = new Line();

    //process
    List<Line> landingSeg = landing.GetSegments().ToList();
    List<Line> perpToStair = new List<Line>();

    double perpTolerance = 0.005;

    foreach (Line i in landingSeg)
    {
      double axisDecider = Math.Abs(Vector3d.Multiply(i.Direction, upstairDirec));
      if (axisDecider < perpTolerance)
        perpToStair.Add(i);
    }

    perpToStair.Sort(delegate (Line x, Line y)
      {
        Point3d perp1Center = x.PointAt(0.5);
        Point3d perp2Center = y.PointAt(0.5);

        Vector3d gapBetween = perp1Center - perp2Center;
        double decider = Vector3d.Multiply(gapBetween, upstairDirec);

        if (decider > 0)
          return -1;
        else if (decider == 0)
          return 0;
        else
          return 1;
      });

    baseSeg = perpToStair[0];

    return baseSeg;
  }

  public double SetBasePtVLimit(Polyline landing, Vector3d upstairDirec, Line baseLine)
  {
    double vLimit = 0;

    Point3d decidingPt1 = baseLine.PointAt(0.01) - upstairDirec / upstairDirec.Length * 0.01;
    Point3d decidingPt2 = baseLine.PointAt(0.09) - upstairDirec / upstairDirec.Length * 0.01;

    double candidate1 = PCXTools.ExtendFromPt(decidingPt1, landing, -upstairDirec).Length + 0.01;
    double candidate2 = PCXTools.ExtendFromPt(decidingPt2, landing, -upstairDirec).Length + 0.01;

    if (candidate1 > candidate2)
      vLimit = candidate2;
    else
      vLimit = candidate1;

    return vLimit;
  }

  public List<Line> SetBaseAxis(Polyline landing, Polyline outline, Vector3d upstairDirec, Line baseLine)
  {
    //output
    List<Line> mainAxis = new List<Line>();

    //process
    double basePtH = SetBasePtVLimit(landing, upstairDirec, baseLine);
    Point3d basePt = baseLine.PointAt(0.5) - (upstairDirec / upstairDirec.Length) * SetBasePtVLimit(landing, upstairDirec, baseLine) / 2;

    //set horizontalAxis, 횡축은 외곽선에서 더 먼 쪽을 선택
    Line horizonReached1 = PCXTools.ExtendFromPt(basePt, outline, baseLine.UnitTangent);
    Line horizonReached2 = PCXTools.ExtendFromPt(basePt, outline, -baseLine.UnitTangent);

    if (horizonReached1.Length > horizonReached2.Length)
      mainAxis.Add(horizonReached1);
    else
      mainAxis.Add(horizonReached2);

    //set verticalAxis, 종축은 외곽선에서 더 가까운 쪽을 선택
    Line verticalReached1 = PCXTools.ExtendFromPt(basePt, outline, upstairDirec);
    Line verticalReached2 = PCXTools.ExtendFromPt(basePt, outline, -upstairDirec);

    if (verticalReached1.Length < verticalReached2.Length)
      mainAxis.Add(verticalReached1);
    else
      mainAxis.Add(verticalReached2);

    return mainAxis;

  }

  public Point3d DrawAnchor1(Vector3d upstairDirec, Line baseLine, List<Line> baseAxis, double corridorWidth, double scale)
  {
    Point3d anchor = new Point3d();

    Point3d basePt = baseAxis[0].PointAt(0);
    Point3d anchorCenter = basePt + baseAxis[0].UnitTangent * (baseLine.Length / 2.0 + corridorWidth / (2 * scale));
    anchor = anchorCenter; //임시

    return anchor;
  }

  public Point3d DrawAnchor2(Point3d anchor1, Polyline coreLine, List<Line> baseAxis, double corridorWidth, double scale)
  {
    Point3d anchor2 = new Point3d();

    double coreSideLimit = PCXTools.ExtendFromPt(baseAxis[0].PointAt(0), coreLine, -baseAxis[1].UnitTangent).Length;
    double scaledCorridorWidth = corridorWidth / scale;
    double vLimit = coreSideLimit + scaledCorridorWidth / 2;

    anchor2 = anchor1 - baseAxis[1].UnitTangent * vLimit;

    return anchor2;
  }

  public Point3d DrawAnchor3(Point3d anchor2, Polyline outline, List<Line>baseAxis, Line baseLine, double hFactor, double corridorWidth, double scale)
  {
    Point3d anchor3 = new Point3d();

    double outlineSideLimit = PCXTools.ExtendFromPt(anchor2, outline, -baseAxis[0].UnitTangent).Length - corridorWidth / (scale * 2);
    double hLimit = baseLine.Length;

    if (outlineSideLimit < hLimit)
      hLimit = outlineSideLimit;

    anchor3 = anchor2 - baseAxis[0].UnitTangent * hLimit * hFactor;

    return anchor3;
  }

  public Point3d DrawAnchor4(Point3d anchor3, Polyline outline, List<Line>baseAxis, double vFactor, double corridorWidth, double scale)
  {
    Point3d anchor4 = new Point3d();

    double vLimit = PCXTools.ExtendFromPt(anchor3, outline, -baseAxis[1].UnitTangent).Length - corridorWidth / (scale * 2);
    anchor4 = anchor3 - baseAxis[1].UnitTangent * vLimit * vFactor;

    return anchor4;
  }

  public Polyline DrawCorridor(List<Point3d> anchors, List<Line> mainAxis, double corridorWidth, double scale)
  {
    Polyline corridor = new Polyline();

    if (anchors.Count < 2)
      return null;

    List<Rectangle3d> rectList = new List<Rectangle3d>();

    for(int i = 0; i < anchors.Count - 1;i++)
    {
      Rectangle3d tempRect = RectangleTools.DrawP2PRect(anchors[i], anchors[i + 1], corridorWidth / scale);
      rectList.Add(tempRect);
    }

    if(rectList.Count > 1)
    {
      Curve intersected = rectList[0].ToNurbsCurve();

      for(int i = 0; i < rectList.Count - 1;i++)
      {
        List<Curve> unionCurves = new List<Curve>();
        unionCurves.Add(intersected);
        unionCurves.Add(rectList[i + 1].ToNurbsCurve());
        intersected = Curve.CreateBooleanUnion(unionCurves)[0];
      }

      corridor = CurveTools.ToPolyline(intersected);
    }

    return corridor;
  }

  class PCXTools
  {
    public static Line ExtendFromPt(Point3d basePt, Polyline boundary, Vector3d direction)
    {
      Line output = new Line();

      double coverAllLength = new BoundingBox(boundary).Diagonal.Length * 2;
      LineCurve lay = new LineCurve(basePt, basePt + direction / direction.Length * coverAllLength);

      var layIntersection = Rhino.Geometry.Intersect.Intersection.CurveCurve(lay, boundary.ToNurbsCurve(), 0, 0);

      List<Point3d> intersectedPts = new List<Point3d>();
      foreach (var i in layIntersection)
        intersectedPts.Add(i.PointA);

      intersectedPts.Sort((x, y) => basePt.DistanceTo(x).CompareTo(basePt.DistanceTo(y)));
      output = new Line(basePt, intersectedPts[0]);

      return output;
    }
  }

  class PolylineTools
  {
    public static List<Point3d> GetVertex(Polyline polyline)
    {
      List<Point3d> tempVertex = new List<Point3d>(polyline);
      tempVertex.RemoveAt(tempVertex.Count - 1);

      return tempVertex;
    }
  }

  class RectangleTools
  {
    public static Rectangle3d DrawP2PRect(Point3d pointStart, Point3d pointEnd, double thickness)
    {
      Rectangle3d p2pRect = new Rectangle3d();

      Vector3d alignP2P = new Line(pointStart, pointEnd).UnitTangent;
      Vector3d perpP2P = VectorTools.RotateVectorXY(alignP2P, Math.PI / 2);

      Point3d corner1 = pointStart - alignP2P * thickness / 2 + perpP2P * thickness / 2;
      Point3d corner2 = pointEnd + alignP2P * thickness / 2 - perpP2P * thickness / 2;
      Plane p2pPlane = new Plane(pointStart, alignP2P, perpP2P);

      p2pRect = new Rectangle3d(p2pPlane, corner1, corner2);

      return p2pRect;
    }
  }

  class VectorTools
  {
    public static Vector3d RotateVectorXY(Vector3d baseVector, double angle)
    {
      Vector3d rotatedVector = new Vector3d(baseVector.X * Math.Cos(angle) - baseVector.Y * Math.Sin(angle), baseVector.X * Math.Sin(angle) + baseVector.Y * Math.Cos(angle), 0);
      return rotatedVector;
    }
  }

  class CurveTools
  {
    public static double GetArea(Curve input)
    {
      Polyline plotPolyline;
      input.TryGetPolyline(out plotPolyline);

      List<Point3d> y = new List<Point3d>(plotPolyline);
      double area = 0;

      for (int i = 0; i < y.Count - 1; i++)
      {
        area += y[i].X * y[i + 1].Y;
        area -= y[i].Y * y[i + 1].X;
      }

      area /= 2;
      return (area < 0 ? -area : area);
    }

    public static Polyline ToPolyline(Curve curve)
    {
      Polyline output = new Polyline();
      curve.TryGetPolyline(out output);
      return output;
    }

  }
# ---------- end pattern2 ----------
c_script_4 = CSharpScript(outline=crv_14, coreLine=crv_13, landing=crv_12, chamberNum=Slider(4, range=0..4))  # -> out, A; inputs outline: Polyline, coreLine: Polyline, landing: Polyline, chamberNum: Int32
# ---------- c_script_4: C# ----------
    Polyline test = MakeCorridor(coreLine, landing, outline);


    A = test;
# ---------- c_script_4: C# additional code ----------
  public Polyline MakeCorridor(Polyline coreLine, Polyline landing, Polyline outline)
  {
    //output
    List<Polyline> output = new List<Polyline>();

    //process
    List<Point3d> landingVertex = Tools.GetVertex(landing);
    List<Vector3d> landingAlign = Tools.SegmentVector.GetAlign(landing, true);
    List<Vector3d> landingPerp = Tools.SegmentVector.GetPerpendicular(landing, true);

    double coverAllLength = new BoundingBox(outline).Diagonal.Length * 2;

    List<Polyline> landingAlignRects = new List<Polyline>();

    for (int i = 0; i < landingVertex.Count; i++)
    {
      Plane tempPlane = new Plane(landingVertex[i], landingAlign[i], landingPerp[i]);
      Rectangle3d tempAlignRects = new Rectangle3d(tempPlane, tempPlane.Origin - tempPlane.XAxis * coverAllLength, tempPlane.Origin + tempPlane.XAxis * coverAllLength + tempPlane.YAxis * 1200);
      landingAlignRects.Add(tempAlignRects.ToPolyline());
    }

    double smallestSum = 0;


    Polyline baseRect = new Polyline();

    for(int i = 0;i < landingAlignRects.Count;i++)
    {

      double tempSum = Tools.GetArea(Tools.RegionIntersect(landingAlignRects[i], coreLine));

      if ((tempSum < smallestSum) || (i == 0))
      {
        smallestSum = tempSum;
        baseRect = landingAlignRects[i];
      }
    }

    Polyline corridors = Tools.RegionIntersect(baseRect, outline);
    return corridors;
  }

  //tools
  class Tools
  {
    public static double GetArea(Polyline input)
    {
      if(!input.IsClosed)
        return 0;

      List<Point3d> y = new List<Point3d>(input);
      double area = 0;

      for (int i = 0; i < y.Count - 1; i++)
      {
        area += y[i].X * y[i + 1].Y;
        area -= y[i].Y * y[i + 1].X;
      }

      area /= 2;
      return (area < 0 ? -area : area);
    }
    public static double GetArea(Curve input)
    {
      if(!input.IsClosed)
        return 0;

      Polyline plotPolyline;
      input.TryGetPolyline(out plotPolyline);

      List<Point3d> y = new List<Point3d>(plotPolyline);
      double area = 0;

      for (int i = 0; i < y.Count - 1; i++)
      {
        area += y[i].X * y[i + 1].Y;
        area -= y[i].Y * y[i + 1].X;
      }

      area /= 2;
      return (area < 0 ? -area : area);
    }

    /// <summary>
    /// 닫힌 폴리라인 방향을 반시계 방향으로 만들어줍니다. (꼭지점의 index 순서 기준)
    /// </summary>
    public static Polyline AlignPolyline(Polyline polyline)
    {
      Polyline output = new Polyline(polyline);
      if (output.ToNurbsCurve().ClosedCurveOrientation(Vector3d.ZAxis) == CurveOrientation.CounterClockwise)
      {
        output.Reverse();
      }
      return output;
    }

    public static List<Point3d> GetVertex(Polyline polyline)
    {
      List<Point3d> tempVertex = new List<Point3d>(polyline);
      tempVertex.RemoveAt(tempVertex.Count - 1);

      return tempVertex;
    }

    public static Polyline ToPolyline(Curve curve)
    {
      Polyline output = new Polyline();
      curve.TryGetPolyline(out output);
      return output;
    }

    public static Vector3d RotateVectorXY(Vector3d baseVector, double angle)
    {
      Vector3d rotatedVector = new Vector3d(baseVector.X * Math.Cos(angle) - baseVector.Y * Math.Sin(angle), baseVector.X * Math.Sin(angle) + baseVector.Y * Math.Cos(angle), 0);
      return rotatedVector;
    }

    /// <summary>
    /// 폴리라인의 각 세그먼트들에 대해 평행한 또는 안쪽으로 수직인 벡터 리스트를 구해줍니다.(반시계방향 기준)
    /// </summary>
    public class SegmentVector
    {
      public static List<Vector3d> GetAlign(Polyline polyline, bool unitize)
      {
        Polyline ccwAlign = AlignPolyline(polyline);
        List<Point3d> tempVertex = new List<Point3d>(ccwAlign);
        tempVertex.RemoveAt(tempVertex.Count() - 1);
        List<Vector3d> alignVector = new List<Vector3d>();
        int numVertex = tempVertex.Count;
        for (int i = 0; i < numVertex; i++)
        {
          Point3d tempStart = tempVertex[i];
          Point3d tempEnd = tempVertex[(numVertex + i + 1) % numVertex];
          Vector3d tempVector = new Vector3d(tempEnd - tempStart); // Align Vector with length

          if (unitize)
            tempVector = tempVector / tempVector.Length;

          alignVector.Add(tempVector);
        }
        return alignVector;
      }

      public static List<Vector3d> GetPerpendicular(Polyline polyline, bool unitize)
      {
        Polyline ccwAlign = AlignPolyline(polyline);
        List<Point3d> tempVertex = new List<Point3d>(ccwAlign);
        tempVertex.RemoveAt(tempVertex.Count() - 1);
        List<Vector3d> perpVector = new List<Vector3d>();
        int numVertex = tempVertex.Count;
        for (int i = 0; i < numVertex; i++)
        {
          Point3d tempStart = tempVertex[i];
          Point3d tempEnd = tempVertex[(numVertex + i + 1) % numVertex];
          Vector3d tempVector = new Vector3d(tempEnd - tempStart); // Align Vector with length
          tempVector.Transform(Transform.Rotation(Math.PI / 2, tempStart));

          if (unitize)
            tempVector = tempVector / tempVector.Length;

          perpVector.Add(tempVector);
        }
        return perpVector;
      }
    }

    /// <summary>
    /// Offset 대상인 폴리라인의 벡터를 이용해 Offset된 폴리라인의 내부 고리를 없애줍니다.
    /// </summary>
    public static List<Curve> RemoveLoop(Polyline loopedPoly, Polyline baseBound, double tolerance)
    {
      Curve loopedCrv = loopedPoly.ToNurbsCurve();
      Curve boundCrv = baseBound.ToNurbsCurve();
      var tempX = Rhino.Geometry.Intersect.Intersection.CurveSelf(loopedCrv, 0);

      List<double> splitParam = new List<double>();
      foreach (var i in tempX)
      {
        splitParam.Add(i.ParameterA);
        splitParam.Add(i.ParameterB);
      }

      List<Curve> splittedSegment = loopedCrv.Split(splitParam).ToList();
      List<Curve> loopOut = new List<Curve>();

      foreach (Curve i in splittedSegment)
      {
        List<Curve> testCrvSet = i.DuplicateSegments().ToList();

        if (testCrvSet.Count == 0)
          testCrvSet.Add(i);

        foreach (Curve j in testCrvSet)
        {
          Vector3d testVec = new Vector3d(j.PointAtEnd - j.PointAtStart);
          Point3d testBase = new Point3d((j.PointAtStart + j.PointAtEnd) / 2);
          testVec.Transform(Transform.Scale(j.PointAtStart, 1 / testVec.Length));
          testVec.Transform(Transform.Rotation(Math.PI / 2, j.PointAtStart));
          Point3d testPt = new Point3d(testBase + testVec * tolerance);

          int decider = (int) loopedCrv.Contains(testPt, Plane.WorldXY, tolerance / 2);
          int decider2 = (int) boundCrv.Contains(testPt, Plane.WorldXY, tolerance / 2);

          if ((decider != 2) && (decider2 != 2))
            loopOut.Add(j);
        }
      }

      List<Curve> joined = Curve.JoinCurves(loopOut).ToList();
      List<Curve> final = new List<Curve>();
      foreach (Curve k in joined)
      {
        Boolean decider3 = k.IsClosed;
        if (decider3 == true)
          final.Add(k);
      }

      return final;
    }

    public static List<Curve> RegionIntersect(List<Curve> curveSet1, List<Curve> curveSet2)
    {
      List<Curve> IntersectCrvs = new List<Curve>();
      foreach (Curve i in curveSet1)
      {
        foreach (Curve j in curveSet2)
        {
          List<double> tempParamA = new List<double>();
          List<double> tempParamB = new List<double>();
          List<Curve> tempLocalResult = new List<Curve>();

          var tempIntersection = Rhino.Geometry.Intersect.Intersection.CurveCurve(i, j, 0, 0);
          foreach (var k in tempIntersection)
          {
            tempParamA.Add(k.ParameterA);
            tempParamB.Add(k.ParameterB);
          }

          List<Curve> tempSplittedA = i.Split(tempParamA).ToList();
          List<Curve> tempSplittedB = j.Split(tempParamB).ToList();

          //case of Curve1
          foreach (Curve k in tempSplittedA)
          {
            List<Curve> testCrvSet = k.DuplicateSegments().ToList();

            if (testCrvSet.Count == 0)
              testCrvSet.Add(k);

            foreach (Curve l in testCrvSet)
            {
              Point3d testPt = new Point3d((l.PointAtEnd + l.PointAtStart) / 2);
              int decider = (int) j.Contains(testPt);

              if (decider != 2)
                tempLocalResult.Add(l);
            }
          }

          //case of Curve2
          foreach (Curve k in tempSplittedB)
          {
            List<Curve> testCrvSet = k.DuplicateSegments().ToList();

            if (testCrvSet.Count == 0)
              testCrvSet.Add(k);

            foreach (Curve l in testCrvSet)
            {
              Point3d testPt = new Point3d((l.PointAtEnd + l.PointAtStart) / 2);
              int decider = (int) i.Contains(testPt);

              if (decider != 2)
                tempLocalResult.Add(l);
            }
          }
          IntersectCrvs.AddRange(Curve.JoinCurves(tempLocalResult).ToList());
        }
      }
      return IntersectCrvs;
    }
    public static Polyline RegionIntersect(Polyline polyline1, Polyline polyline2)
    {
      Polyline resultPolyine = new Polyline();

      List<double> tempParamA = new List<double>(); //Polyline1 위의 교차점
      List<double> tempParamB = new List<double>(); //Polyline1 위의 교차점
      Curve polyCurve1 = polyline1.ToNurbsCurve();
      Curve polyCurve2 = polyline2.ToNurbsCurve();

      List<Curve> tempLocalResult = new List<Curve>();

      var tempIntersection = Rhino.Geometry.Intersect.Intersection.CurveCurve(polyCurve1, polyCurve2, 0, 0);
      foreach (var i in tempIntersection)
      {
        tempParamA.Add(i.ParameterA);
        tempParamB.Add(i.ParameterB);
      }

      List<Curve> tempSplittedA = polyCurve1.Split(tempParamA).ToList();
      List<Curve> tempSplittedB = polyCurve2.Split(tempParamB).ToList();

      //case of Polyline1
      foreach (Curve i in tempSplittedA)
      {
        List<Curve> testCrvSet = i.DuplicateSegments().ToList();

        if (testCrvSet.Count == 0)
          testCrvSet.Add(i);

        foreach (Curve j in testCrvSet)
        {
          Point3d testPt = new Point3d((j.PointAtEnd + j.PointAtStart) / 2);
          int decider = (int) polyCurve2.Contains(testPt);

          if (decider != 2)
            tempLocalResult.Add(j);
        }
      }

      //case of Polyline2
      foreach (Curve i in tempSplittedB)
      {
        List<Curve> testCrvSet = i.DuplicateSegments().ToList();

        if (testCrvSet.Count == 0)
          testCrvSet.Add(i);

        foreach (Curve j in testCrvSet)
        {
          Point3d testPt = new Point3d((j.PointAtEnd + j.PointAtStart) / 2);
          int decider = (int) polyCurve1.Contains(testPt);

          if (decider != 2)
            tempLocalResult.Add(j);
        }
      }
      List<Curve> resultList = Curve.JoinCurves(tempLocalResult).ToList();
      resultList.OrderByDescending(i => GetArea(i));

      if (resultList.Count != 0)
        resultPolyine = ToPolyline(resultList[0]);

      return resultPolyine;
    }

    /// <summary>
    /// 폴리라인의 각 변마다 거리를 지정해 Offset 커브를 만들어줍니다.
    /// </summary>
    public static List<Curve> ImprovedOffset(Polyline bound, List<double> offsetDist)
    {
      Polyline ccwBound = AlignPolyline(bound);
      List<Point3d> trimmedOffsetPt = new List<Point3d>();

      //set vectors
      List<Vector3d> alignVector = SegmentVector.GetAlign(ccwBound, true);
      List<Vector3d> perpVector = SegmentVector.GetPerpendicular(ccwBound, true);
      List<Point3d> boundVertex = GetVertex(ccwBound);

      int numSegment = alignVector.Count;
      int numVertex = boundVertex.Count;


      //offset and trim segments
      for (int i = 0; i < numSegment; i++)
      {
        double a = offsetDist[i];
        double b = offsetDist[(i + 1) % offsetDist.Count];
        double dotProduct = Vector3d.Multiply(alignVector[i], alignVector[(i + 1) % numSegment]);
        Vector3d crossProduct = Vector3d.CrossProduct(alignVector[i], alignVector[(i + 1) % numSegment]);
        double cos = Math.Abs(dotProduct / (alignVector[i].Length * alignVector[(i + 1) % numSegment].Length));
        double sin = Math.Sqrt(1 - Math.Pow(cos, 2));

        double decider1 = Vector3d.Multiply(Plane.WorldXY.ZAxis, crossProduct);
        double decider2 = Vector3d.Multiply(-alignVector[i], alignVector[(i + 1) % numSegment]);

        Point3d tempPt = new Point3d();

        if (decider1 > 0) // concave
        {
          if (decider2 < 0) // blunt
            tempPt = boundVertex[(i + 1) % numVertex] + perpVector[i] * a + alignVector[i] * ((a * cos - b) / sin);
          else // acute (right angle included)
            tempPt = boundVertex[(i + 1) % numVertex] + perpVector[i] * a + alignVector[i] * ((-a * cos - b) / sin);
        }

        else if (decider1 < 0) // convex
        {
          if (decider2 < 0) //blunt
            tempPt = boundVertex[(i + 1) % numVertex] + perpVector[i] * a + alignVector[i] * ((-a * cos + b) / sin);
          else // acute (right angle included)
            tempPt = boundVertex[(i + 1) % numVertex] + perpVector[i] * a + alignVector[i] * ((a * cos + b) / sin);
        }

        else //straight
          tempPt = boundVertex[(i + 1) % numVertex] + perpVector[i] * Math.Max(a, b);

        trimmedOffsetPt.Add(tempPt);
      }

      trimmedOffsetPt.Add(trimmedOffsetPt[0]);
      Polyline offBound = new Polyline(trimmedOffsetPt);

      //remove loop
      //List<Curve> loopOut = RemoveLoop(offBound, ccwBound, 0.001);
      //return loopOut;

      List<Curve> debug = new List<Curve>();
      debug.Add(offBound.ToNurbsCurve());
      return debug;
    }

    public class IsotheticOutput
    {
      //constructor
      public IsotheticOutput(Point3d origin, List<Line> axes, Polyline isothetic)
      {
        this.Origin = origin;
        this.Axes = axes;
        this.Isothetic = isothetic;
      }

      public IsotheticOutput(IsotheticOutput isotheticOutput)
      {
        this.Origin = isotheticOutput.Origin;
        this.Axes = isotheticOutput.Axes;
        this.Isothetic = isotheticOutput.Isothetic;
      }

      public IsotheticOutput()
      { }

      //property
      public Point3d Origin { get; set;}
      public Polyline Isothetic { get; set;}
      public List<Line> Axes { get; set;}


    }

    /// <summary>
    /// 지정한 폴리라인에 내접하는, k번 꺾인 직각볼록다각형을 만들어줍니다.
    /// </summary>
    public class kConcaveIsothetic
    {
      //output class


      //main method
      public static IsotheticOutput DrawIsothetic(Polyline boundary, int numberOfConcave, int seed)
      {
        if ((boundary == null) || (boundary.Count == 0))
          return null;

        else
        {
          Point3d origin = new Point3d();
          List<Line> axes = new List<Line>();
          List<List<double>> rectFactors = GetIsotheticFactors(boundary, numberOfConcave, seed, out origin, out axes);

          List<Point3d> polylineVertices = new List<Point3d>();
          polylineVertices.Add(origin);

          Vector3d mainAxis = axes[0].UnitTangent;
          Vector3d subAxis = axes[1].UnitTangent;

          double baseHeight = 0;


          for (int i = 0; i < rectFactors.Count; i++)
          {
            List<double> blockFactor = rectFactors[i];
            polylineVertices.Add(new Point3d(origin + mainAxis * blockFactor[0] + subAxis * baseHeight));
            polylineVertices.Add(new Point3d(origin + mainAxis * blockFactor[0] + subAxis * (baseHeight + blockFactor[1])));

            if (i == rectFactors.Count - 1)
              polylineVertices.Add(new Point3d(origin + subAxis * (baseHeight + blockFactor[1])));

            baseHeight += blockFactor[1];
          }

          polylineVertices.Add(polylineVertices[0]);
          Polyline polylineOutput = new Polyline(polylineVertices);

          IsotheticOutput output = new IsotheticOutput(origin, axes, polylineOutput);
          return output;
        }
      }

      public static IsotheticOutput DrawStrict(Polyline boundary, int numberOfConcave, Point3d origin, List<Line> biasAxes)
      {
        List<Line> newAxes = new List<Line>();
        List<List<double>> rectFactors = GetIsotheticFactorsStrict(boundary, numberOfConcave, origin, biasAxes, out newAxes);

        List<Point3d> polylineVertices = new List<Point3d>();
        polylineVertices.Add(origin);

        Vector3d mainAxis = newAxes[0].UnitTangent;
        Vector3d subAxis = newAxes[1].UnitTangent;

        double baseHeight = 0;


        for (int i = 0; i < rectFactors.Count; i++)
        {
          List<double> blockFactor = rectFactors[i];
          polylineVertices.Add(new Point3d(origin + mainAxis * blockFactor[0] + subAxis * baseHeight));
          polylineVertices.Add(new Point3d(origin + mainAxis * blockFactor[0] + subAxis * (baseHeight + blockFactor[1])));

          if (i == rectFactors.Count - 1)
            polylineVertices.Add(new Point3d(origin + subAxis * (baseHeight + blockFactor[1])));

          baseHeight += blockFactor[1];
        }

        polylineVertices.Add(polylineVertices[0]);
        Polyline polylineOutput = new Polyline(polylineVertices);

        IsotheticOutput isotheticOutput = new IsotheticOutput(origin, newAxes, polylineOutput);
        return isotheticOutput;
      }

      //method for common
      private static List<List<double>> GetIsotheticFactors(Polyline bound, int NumberOfConcave, int seed, out Point3d basePt, out List<Line> baseAxes)
      {
        double bestArea = new Double();
        Point3d bestBasePt = new Point3d();
        List<List<double>> blockFactors = new List<List<double>>();
        List<Line> bestAxes = new List<Line>();

        List<double> axisAngleSet = SetAxisAngle(bound, Math.PI, Math.PI, 5, true);
        List<Point3d> initPts = SetInitPts(bound, seed + 11, 20);
        initPts.AddRange(SetInitPts(bound, seed + 66, 3));

        for (int i = 0; i < axisAngleSet.Count; i++)
        {
          double testAngle = axisAngleSet[i];
          for (int j = 0; j < initPts.Count; j++)
          {
            Point3d testBasePt = initPts[j];
            List<Line> testAxes = setMainAxis(bound, testBasePt, testAngle);
            double testWidth = testAxes[0].Length;
            double testHeight = testAxes[1].Length;
            double testBest = new double();
            List<List<double>> testBlockFactors = new List<List<double>>();

            if (testWidth * testHeight > bestArea) //first seive
            {
              List<double> testRatios = SetAspectRatios(1, 3, 9);
              testBlockFactors = makeBlock(bound, testBasePt, testAxes, testRatios, NumberOfConcave, 3, 0, out testBest);
            }

            if (testBest > bestArea)
            {
              bestArea = testBest;
              bestBasePt = testBasePt;
              blockFactors = testBlockFactors;
              bestAxes = testAxes;
            }

          }
        }

        basePt = bestBasePt;
        baseAxes = bestAxes;
        return blockFactors;
      }

      private static List<List<double>> makeBlock(Polyline bound, Point3d basePt, List<Line> axes, List<double> ratioSet, int NumberOfConcave, double minLength, double minOffset, out double blockArea)
      {
        double bestArea = new Double();

        List<List<double>> output = new List<List<double>>();
        Point3d nextPt = basePt;

        foreach (double aspectRatio in ratioSet)
        {
          double currentBest = new double();
          double subBest = new double();
          List<List<double>> currentOutput = new List<List<double>>();


          List<double> currentBlockFactors = FindMaxWidthHeight(bound, basePt, new Plane(basePt, axes[0].UnitTangent, axes[1].UnitTangent), aspectRatio, 0, axes[0].Length - minOffset, minLength, 8); //second seive
          nextPt = new Point3d(basePt + axes[1].UnitTangent * currentBlockFactors[1]);
          List<Line> nextAxes = new List<Line>();
          nextAxes.Add(new Line(nextPt, nextPt + (axes[0].UnitTangent) * currentBlockFactors[0]));
          nextAxes.Add(new Line(nextPt, axes[1].To));


          if (NumberOfConcave == 0)
          {
            currentOutput.Add(currentBlockFactors);
            subBest = 0;
          }
          else
          {
            currentOutput.Add(currentBlockFactors);
            currentOutput.AddRange(makeBlock(bound, nextPt, nextAxes, ratioSet, NumberOfConcave - 1, 3, 3, out subBest));
          }

          currentBest = subBest + currentBlockFactors[0] * currentBlockFactors[1];

          if (currentBest > bestArea)
          {
            bestArea = currentBest;
            output = currentOutput;
          }
        }

        blockArea = bestArea;
        return output;
      }

      private static List<double> SetAxisAngle(Polyline bound, double baseAngle, double angleRange, int angleRes, bool addSegAlign)
      {
        List<double> outputAngle = new List<double>();

        //add angle by rotation
        for (int i = -angleRes; i < angleRes + 1; i++)
          outputAngle.Add(baseAngle + angleRange / (angleRes * 2) * i);


        //add angle by segments
        if (addSegAlign)
        {
          List<Line> boundSeg = bound.GetSegments().ToList();
          boundSeg.OrderByDescending(i => i.Length);
          int numberOfSegmentAngle = 5;

          for (int i = 0; i < Math.Min(numberOfSegmentAngle, boundSeg.Count); i++)
            outputAngle.Add(Vector3d.VectorAngle(boundSeg[i].UnitTangent, Vector3d.XAxis));
        }

        //
        return outputAngle;
      }

      private static List<Point3d> SetInitPts(Polyline bound, int seed, double strictLevel)
      {
        List<Point3d> outputPts = new List<Point3d>();

        Random rand1 = new Random(seed);
        Random rand2 = new Random(seed + 7);

        Polyline ccwBound = AlignPolyline(bound);
        List<Point3d> boundVertex = new List<Point3d>(ccwBound);
        boundVertex.RemoveAt(boundVertex.Count - 1);
        int vertCount = boundVertex.Count;

        for (int i = 0; i < vertCount; i++)
        {
          Vector3d segVectorA = new Vector3d(boundVertex[(vertCount + i - 1) % vertCount] - boundVertex[i]);
          Vector3d segVectorB = new Vector3d(boundVertex[(vertCount + i + 1) % vertCount] - boundVertex[i]);
          int isConvex = Math.Sign(Vector3d.CrossProduct(segVectorA, segVectorB) * Vector3d.ZAxis * -1);

          Point3d tempPt = Point3d.Unset;
          int breaker = 0;

          while ((int) ccwBound.ToNurbsCurve().Contains(tempPt) != 1)
          {
            if (breaker == 5) // need to make a solution for near-straight angles
            {
              tempPt = bound.CenterPoint();
              break;
            }

            double coefficientA = rand1.NextDouble() * isConvex * 1 / strictLevel;
            double coefficientB = rand2.NextDouble() * isConvex * 1 / strictLevel;
            tempPt = new Point3d(boundVertex[i] + coefficientA * segVectorA + coefficientB * segVectorB);

            breaker++;
          }

          outputPts.Add(tempPt);
        }
        return outputPts;
      }

      private static List<Line> setMainAxis(Polyline bound, Point3d basePt, double axisAngle)
      {
        List<Line> outputLines = new List<Line>();

        List<Point3d> boundVertex = new List<Point3d>(bound);
        BoundingBox boundaryBox = new BoundingBox(boundVertex);
        double axisLength = boundaryBox.Diagonal.Length;

        List<Vector3d> axisSet = new List<Vector3d>();
        List<Point3d> reachedPts = new List<Point3d>();

        for (int i = 0; i < 4; i++)
        {
          Vector3d tempAxis = RotateVectorXY(Vector3d.XAxis, axisAngle + Math.PI / 2 * i);

          LineCurve acrossing = new LineCurve(basePt, new Point3d(basePt + tempAxis * axisLength));
          var tempIntersection = Rhino.Geometry.Intersect.Intersection.CurveCurve(acrossing, bound.ToNurbsCurve(), 0, 0);

          List<Point3d> tempPtSet = new List<Point3d>();
          foreach (var j in tempIntersection)
            tempPtSet.Add(j.PointA);

          List<Point3d> sortedPtSet = tempPtSet.OrderBy(p => basePt.DistanceTo(p)).ToList();

          if (sortedPtSet.Count != 0)
            reachedPts.Add(sortedPtSet[0]);
          else
            reachedPts.Add(basePt); //예외..
        }

        List<Point3d> sortedReachedPts = reachedPts.OrderByDescending(p => basePt.DistanceTo(p)).ToList();
        outputLines.Add(new Line(basePt, sortedReachedPts[0]));

        if (Vector3d.Multiply(new Vector3d(sortedReachedPts[0] - basePt), new Vector3d(sortedReachedPts[1] - basePt)) < -0.005) // could not catch a right angle properly.. a problem of tolerance
          outputLines.Add(new Line(basePt, sortedReachedPts[2]));
        else
          outputLines.Add(new Line(basePt, sortedReachedPts[1]));

        return outputLines;
      }

      private static List<double> SetAspectRatios(double minRatio, double maxRatio, int ratioRes)
      {
        List<double> outputRatios = new List<double>();

        if (minRatio < maxRatio)
          for (int i = 0; i < ratioRes + 1; i++)
            outputRatios.Add(minRatio * (Math.Pow(maxRatio / minRatio, (double) i / ratioRes)));


        return outputRatios;
      }

      private static List<double> FindMaxWidthHeight(Polyline bound, Point3d basePt, Plane basePlane, double aspectRatio, double lowerBound, double upperBound, double heightLimit, int numberOfIter)
      {
        //using binary search
        Curve tester = bound.ToNurbsCurve();
        double tempLower = lowerBound;
        double tempUpper = upperBound;
        List<double> widthAndHeight = new List<double>();

        int iterCount = 0;

        while (tempLower <= tempUpper)
        {
          if (iterCount == numberOfIter)
            break;

          double tempWidth = tempLower + (tempUpper - tempLower) / 2;
          double tempHeight = tempWidth / aspectRatio;

          if (tempHeight > heightLimit) //sieve
          {
            Point3d corner1 = new Point3d(basePt);
            Point3d corner2 = new Point3d(basePt + basePlane.XAxis * tempWidth + basePlane.YAxis * tempHeight);

            Rectangle3d tempRect = new Rectangle3d(basePlane, corner1, corner2);
            Curve testRect = tempRect.ToNurbsCurve();

            var tempIntersect = Rhino.Geometry.Intersect.Intersection.CurveCurve(testRect, tester, 0, 0);
            int decider = tempIntersect.Count;

            if (decider == 0)
              tempLower = tempWidth;

            else
              tempUpper = tempWidth;
          }

          iterCount++;
        }

        double resultHeight = tempLower / aspectRatio;
        if (resultHeight < heightLimit)
          resultHeight = 0;

        widthAndHeight.Add(tempLower);
        widthAndHeight.Add(resultHeight);

        return widthAndHeight;
      }


      //method for strict drawing

      private static List<List<double>> GetIsotheticFactorsStrict(Polyline boundary, int numberOfConcave, Point3d origin, List<Line> biasAxes, out List<Line> newAxes)
      {
        double bestArea = new Double();
        List<List<double>> blockFactors = new List<List<double>>();

        List<Line> axes = setMainAxisStrict(boundary, origin, biasAxes);

        List<double> testRatios = SetAspectRatios(1, 3, 9);
        blockFactors = makeBlock(boundary, origin, axes, testRatios, numberOfConcave, 3, 0, out bestArea);

        newAxes = axes;
        return blockFactors;
      }

      public static List<Line> setMainAxisStrict(Polyline bound, Point3d basePt, List<Line> biasAxes)
      {
        List<Line> outputLines = new List<Line>();

        Curve boundCrv = bound.ToNurbsCurve();
        List<Point3d> reachedPts = new List<Point3d>();

        double axisRayLength = new BoundingBox(bound).Diagonal.Length;
        List<Vector3d> biasVector = new List<Vector3d>();

        for (int i = 0; i < biasAxes.Count; i++)
        {
          biasVector.Add(biasAxes[i].UnitTangent);
          biasVector.Add(biasAxes[i].UnitTangent * -1);
        }

        for (int i = 0; i < biasVector.Count; i++)
        {
          LineCurve tempAxisRay = new LineCurve(basePt, basePt + biasVector[i] * axisRayLength);
          var tempIntersection = Rhino.Geometry.Intersect.Intersection.CurveCurve(tempAxisRay, boundCrv, 0, 0);

          List<Point3d> intersectPts = new List<Point3d>();
          foreach (var j in tempIntersection)
            intersectPts.Add(j.PointA);

          if (intersectPts.Count() == 0)
            intersectPts.Add(basePt);

          intersectPts.Sort((Point3d x, Point3d y) => basePt.DistanceTo(x).CompareTo(basePt.DistanceTo(y)));
          reachedPts.Add(intersectPts[0]);
        }

        reachedPts.Sort((Point3d x, Point3d y) => -(basePt.DistanceTo(x).CompareTo(basePt.DistanceTo(y))));

        outputLines.Add(new Line(basePt, reachedPts[0]));

        if (Vector3d.Multiply(new Vector3d(reachedPts[0] - basePt), new Vector3d(reachedPts[1] - basePt)) < -0.05) // could not catch a right angle properly.. a problem of tolerance
          outputLines.Add(new Line(basePt, reachedPts[2]));
        else
          outputLines.Add(new Line(basePt, reachedPts[1]));

        return outputLines;
      }
    }

    public static double SumDouble(List<double> doubleList)
    {
      double result = new double();

      foreach (double i in doubleList)
        result += i;

      return result;
    }
  }
# ---------- end c_script_4 ----------
panel_2 = Panel(pattern1_2.E)
panel_3 = Panel(pattern2.out)
crv_15 = Curve(pattern2.E)
pt_2 = Point([pattern2.A, pattern2.B, pattern2.C, pattern2.D])
crv_16 = Curve(pattern1_2.A)
panel_4 = Panel(pattern1_2.out)
azure_2 = ColourRGB(Alpha=255, Red=67, Green=156, Blue=210)
yellow_2 = ColourRGB(Alpha=255, Red=207, Green=211, Blue=49)
crv_17 = Curve(pattern1_2.B)
azure_3 = ColourRGB(Alpha=255, Red=67, Green=156, Blue=210)
preview_4 = CustomPreview(Geometry=crv_17, Shader=azure_2)
preview_5 = CustomPreview(Geometry=crv_16, Shader=yellow_2)
rgb = ColourRGB(Alpha=255, Red=Slider(67, range=0..255), Green=Slider(156, range=0..255), Blue=Slider(210, range=0..255))
crv_18 = Curve(c_script_4.A)
panel_5 = Panel(c_script_4.out)
preview_6 = CustomPreview(Geometry=crv_15, Shader=azure_3)
preview_7 = CustomPreview(Geometry=crv_18, Shader=rgb)

crv_19 = Curve(<curve referenced from the Rhino model>)
crv_20 = Curve(<curve referenced from the Rhino model>)
crv_21 = Curve(<curve referenced from the Rhino model>)
c_script_5 = CSharpScript(x=crv_20)  # -> out, A; inputs x: Polyline
# ---------- c_script_5: C# ----------
    List<Vector3d> test = SegmentVector.GetAlign(x, true);
    A = test[1];
# ---------- c_script_5: C# additional code ----------
  public static Polyline AlignPolyline(Polyline polyline)
  {
    Polyline output = new Polyline(polyline);
    if (output.ToNurbsCurve().ClosedCurveOrientation(Vector3d.ZAxis) == CurveOrientation.CounterClockwise)
    {
      output.Reverse();
    }
    return output;
  }

  public static List<Point3d> GetVertex(Polyline polyline)
  {
    List<Point3d> tempVertex = new List<Point3d>(polyline);
    tempVertex.RemoveAt(tempVertex.Count - 1);

    return tempVertex;
  }

  public static Polyline ToPolyline(Curve curve)
  {
    Polyline output = new Polyline();
    curve.TryGetPolyline(out output);
    return output;
  }

  public static Vector3d RotateVectorXY(Vector3d baseVector, double angle)
  {
    Vector3d rotatedVector = new Vector3d(baseVector.X * Math.Cos(angle) - baseVector.Y * Math.Sin(angle), baseVector.X * Math.Sin(angle) + baseVector.Y * Math.Cos(angle), 0);
    return rotatedVector;
  }

  /// <summary>
  /// 폴리라인의 각 세그먼트들에 대해 평행한 또는 안쪽으로 수직인 벡터 리스트를 구해줍니다.(반시계방향 기준)
  /// </summary>
  public class SegmentVector
  {
    public static List<Vector3d> GetAlign(Polyline polyline, bool unitize)
    {
      Polyline ccwAlign = AlignPolyline(polyline);
      List<Point3d> tempVertex = new List<Point3d>(ccwAlign);
      tempVertex.RemoveAt(tempVertex.Count() - 1);
      List<Vector3d> alignVector = new List<Vector3d>();
      int numVertex = tempVertex.Count;
      for (int i = 0; i < numVertex; i++)
      {
        Point3d tempStart = tempVertex[i];
        Point3d tempEnd = tempVertex[(numVertex + i + 1) % numVertex];
        Vector3d tempVector = new Vector3d(tempEnd - tempStart); // Align Vector with length

        if (unitize)
          tempVector = tempVector / tempVector.Length;

        alignVector.Add(tempVector);
      }
      return alignVector;
    }

    public static List<Vector3d> GetPerpendicular(Polyline polyline, bool unitize)
    {
      Polyline ccwAlign = AlignPolyline(polyline);
      List<Point3d> tempVertex = new List<Point3d>(ccwAlign);
      tempVertex.RemoveAt(tempVertex.Count() - 1);
      List<Vector3d> perpVector = new List<Vector3d>();
      int numVertex = tempVertex.Count;
      for (int i = 0; i < numVertex; i++)
      {
        Point3d tempStart = tempVertex[i];
        Point3d tempEnd = tempVertex[(numVertex + i + 1) % numVertex];
        Vector3d tempVector = new Vector3d(tempEnd - tempStart); // Align Vector with length
        tempVector.Transform(Transform.Rotation(Math.PI / 2, tempStart));

        if (unitize)
          tempVector = tempVector / tempVector.Length;

        perpVector.Add(tempVector);
      }
      return perpVector;
    }
  }
# ---------- end c_script_5 ----------
pattern3 = CSharpScript(
    outline=crv_19,
    coreLine=crv_20,
    landing=crv_21,
    upstairDirec=c_script_5.A,
    a1VFactor=Slider(1, range=0.001..1),
    a2HFactor1=Slider(0.001, range=0.001..1),
    a2HFactor2=Slider(0.001, range=0.001..1))  # -> out, A, B, C; inputs outline: Polyline, coreLine: Polyline, landing: Polyline, upstairDirec: Vector3d, a1VFactor: Double, a2HFactor1: Double, a2HFactor2: Double
# ---------- pattern3: C# ----------
    Line baseLine = SearchBaseLine(landing, upstairDirec);
    List<Line> baseAxis = SetBaseAxis(landing, outline, upstairDirec, baseLine);
    List<Point3d> anchors = DrawAnchor1(upstairDirec, baseLine, baseAxis, a1VFactor, 1800,1);
    List<double> hFactors = new List<double>();
    hFactors.Add(a2HFactor1);
    hFactors.Add(a2HFactor2);
    List<Point3d> anchors2 = DrawAnchor2(anchors, outline, baseAxis, hFactors, 1800, 1);
    List<Polyline> corridors = DrawCorridor(anchors, anchors2, 1800, 1);

    A = anchors;
    B = anchors2;
    C = corridors;
# ---------- pattern3: C# additional code ----------
  public Line SearchBaseLine(Polyline landing, Vector3d upstairDirec)
  {
    //output
    Line baseSeg = new Line();

    //process
    List<Line> landingSeg = landing.GetSegments().ToList();
    List<Line> perpToStair = new List<Line>();

    double perpTolerance = 0.005;

    foreach (Line i in landingSeg)
    {
      double axisDecider = Math.Abs(Vector3d.Multiply(i.Direction, upstairDirec));
      if (axisDecider < perpTolerance)
        perpToStair.Add(i);
    }

    perpToStair.Sort(delegate (Line x, Line y)
      {
        Point3d perp1Center = x.PointAt(0.5);
        Point3d perp2Center = y.PointAt(0.5);

        Vector3d gapBetween = perp1Center - perp2Center;
        double decider = Vector3d.Multiply(gapBetween, upstairDirec);

        if (decider > 0)
          return -1;
        else if (decider == 0)
          return 0;
        else
          return 1;
      });

    baseSeg = perpToStair[0];

    return baseSeg;
  }

  public double SetBasePtYLimit(Polyline landing, Vector3d upstairDirec, Line baseLine)
  {
    double yLimit = 0;

    Point3d decidingPt1 = baseLine.PointAt(0.01) - upstairDirec / upstairDirec.Length * 0.1;
    Point3d decidingPt2 = baseLine.PointAt(0.09) - upstairDirec / upstairDirec.Length * 0.1;

    double candidate1 = PCXTools.ExtendFromPt(decidingPt1, landing, -upstairDirec).Length + 0.1;
    double candidate2 = PCXTools.ExtendFromPt(decidingPt2, landing, -upstairDirec).Length + 0.1;

    if (candidate1 > candidate2)
      yLimit = candidate2;
    else
      yLimit = candidate1;

    return yLimit;
  }

  public List<Line> SetBaseAxis(Polyline landing, Polyline outline, Vector3d upstairDirec, Line baseLine)
  {
    //output
    List<Line> mainAxis = new List<Line>();

    //process
    double basePtY = SetBasePtYLimit(landing, upstairDirec, baseLine);
    Point3d basePt = baseLine.PointAt(0.5) - (upstairDirec / upstairDirec.Length) * SetBasePtYLimit(landing, upstairDirec, baseLine) / 2;

    //set horizontalAxis, 횡축은 외곽선에서 더 먼 쪽을 선택
    Line horizonReached1 = PCXTools.ExtendFromPt(basePt, outline, baseLine.UnitTangent);
    Line horizonReached2 = PCXTools.ExtendFromPt(basePt, outline, -baseLine.UnitTangent);

    if (horizonReached1.Length > horizonReached2.Length)
      mainAxis.Add(horizonReached1);
    else
      mainAxis.Add(horizonReached2);

    //set verticalAxis, 종축은 외곽선에서 더 가까운 쪽을 선택
    Line verticalReached1 = PCXTools.ExtendFromPt(basePt, outline, upstairDirec);
    Line verticalReached2 = PCXTools.ExtendFromPt(basePt, outline, -upstairDirec);

    if (verticalReached1.Length < verticalReached2.Length)
      mainAxis.Add(verticalReached1);
    else
      mainAxis.Add(verticalReached2);

    return mainAxis;

  }

  public List<Point3d> DrawAnchor1(Vector3d upstairDirec, Line baseLine, List<Line> baseAxis, double vFactor, double corridorWidth, double scale)
  {
    //output
    List<Point3d> anchors = new List<Point3d>();

    //base setting
    double minChamberWidth = 3000 / scale; //최소 방 너비
    double scaledCorridorwidth = corridorWidth / scale;
    double baseHalfVSize = baseLine.PointAt(0.5).DistanceTo(baseAxis[0].PointAt(0));
    double baseHalfHSize = baseLine.Length / 2;

    //set vertical limit
    List<double> limitCandidates = new List<double>();

    limitCandidates.Add(-baseHalfVSize + scaledCorridorwidth / 2);
    limitCandidates.Add(baseHalfVSize - scaledCorridorwidth / 2);
    double minChamberLimit = (minChamberWidth + scaledCorridorwidth / 2) - baseAxis[1].Length;
    limitCandidates.Add(minChamberLimit);

    limitCandidates.Sort((x,y) => -x.CompareTo(y));

    double limitUpper = limitCandidates[0];
    double limitLower = limitCandidates[1];

    if (limitLower < minChamberLimit)
      return null;

    double vLimit = limitUpper - limitLower;

    //draw anchors, 일단 둘 다..
    Vector3d hAxis = baseAxis[0].UnitTangent;
    Vector3d vAxis = baseAxis[1].UnitTangent;
    Point3d Anchor1first = baseAxis[0].PointAt(0) + hAxis * (baseHalfHSize + scaledCorridorwidth / 2) - vAxis * (limitLower + vLimit * vFactor); //횡장축부터, from horizontal-longerAxis
    Point3d Anchor1second = baseAxis[0].PointAt(0) - hAxis * (baseHalfHSize + scaledCorridorwidth / 2) - vAxis * (limitLower + vLimit * vFactor);

    anchors.Add(Anchor1first);
    anchors.Add(Anchor1second);

    return anchors;
  }

  public List<Point3d> DrawAnchor2(List<Point3d> anchor1, Polyline outline, List<Line> mainAxis, List<double> hFactors, double corridorWidth, double scale)
  {
    List<Point3d> anchor2 = new List<Point3d>();

    for(int i = 0; i < anchor1.Count;i++)
    {
      Vector3d tempAxis = mainAxis[0].UnitTangent * Math.Pow(-1, i);
      double hLimit = PCXTools.ExtendFromPt(anchor1[i], outline, tempAxis).Length - corridorWidth / (2 * scale);
      anchor2.Add(anchor1[i] + tempAxis * hLimit * hFactors[i]);
    }

    return anchor2;
  }

  public List<Polyline> DrawCorridor(List<Point3d> anchor1, List<Point3d> anchor2, double corridorWidth, double scale)
  {
    List<Polyline> corridors = new List<Polyline>();

    for(int i = 0; i < anchor1.Count;i++)
    {
      Rectangle3d tempRect = RectangleTools.DrawP2PRect(anchor1[i], anchor2[i], corridorWidth / scale);
      corridors.Add(tempRect.ToPolyline());
    }

    return corridors;
  }

  class VectorTools
  {
    public static Vector3d RotateVectorXY(Vector3d baseVector, double angle)
    {
      Vector3d rotatedVector = new Vector3d(baseVector.X * Math.Cos(angle) - baseVector.Y * Math.Sin(angle), baseVector.X * Math.Sin(angle) + baseVector.Y * Math.Cos(angle), 0);
      return rotatedVector;
    }
  }

  class RectangleTools
  {
    public static Rectangle3d DrawP2PRect(Point3d pointStart, Point3d pointEnd, double thickness)
    {
      Rectangle3d p2pRect = new Rectangle3d();

      Vector3d alignP2P = new Line(pointStart, pointEnd).UnitTangent;
      Vector3d perpP2P = VectorTools.RotateVectorXY(alignP2P, Math.PI / 2);

      Point3d corner1 = pointStart - alignP2P * thickness / 2 + perpP2P * thickness / 2;
      Point3d corner2 = pointEnd + alignP2P * thickness / 2 - perpP2P * thickness / 2;
      Plane p2pPlane = new Plane(pointStart, alignP2P, perpP2P);

      p2pRect = new Rectangle3d(p2pPlane, corner1, corner2);

      return p2pRect;
    }
  }

  class PolylineTools
  {
    public static double GetArea(Polyline input)
    {
      List<Point3d> y = new List<Point3d>(input);
      double area = 0;

      for (int i = 0; i < y.Count - 1; i++)
      {
        area += y[i].X * y[i + 1].Y;
        area -= y[i].Y * y[i + 1].X;
      }

      area /= 2;
      return (area < 0 ? -area : area);
    }

    /// <summary>
    /// 닫힌 폴리라인 방향을 반시계 방향으로 만들어줍니다. (꼭지점의 index 순서 기준)
    /// </summary>
    public static Polyline AlignPolyline(Polyline polyline)
    {
      Polyline output = new Polyline(polyline);
      if (output.ToNurbsCurve().ClosedCurveOrientation(Vector3d.ZAxis) == CurveOrientation.CounterClockwise)
      {
        output.Reverse();
      }
      return output;
    }

    public static List<Point3d> GetVertex(Polyline polyline)
    {
      List<Point3d> tempVertex = new List<Point3d>(polyline);
      tempVertex.RemoveAt(tempVertex.Count - 1);

      return tempVertex;
    }

    /// <summary>
    /// 폴리라인의 각 세그먼트들에 대해 평행한 또는 안쪽으로 수직인 벡터 리스트를 구해줍니다.(반시계방향 기준)
    /// </summary>
    public class SegmentVector
    {
      public static List<Vector3d> GetAlign(Polyline polyline, bool unitize)
      {
        Polyline ccwAlign = AlignPolyline(polyline);
        List<Point3d> tempVertex = new List<Point3d>(ccwAlign);
        tempVertex.RemoveAt(tempVertex.Count() - 1);
        List<Vector3d> alignVector = new List<Vector3d>();
        int numVertex = tempVertex.Count;
        for (int i = 0; i < numVertex; i++)
        {
          Point3d tempStart = tempVertex[i];
          Point3d tempEnd = tempVertex[(numVertex + i + 1) % numVertex];
          Vector3d tempVector = new Vector3d(tempEnd - tempStart); // Align Vector with length

          if (unitize)
            tempVector = tempVector / tempVector.Length;

          alignVector.Add(tempVector);
        }
        return alignVector;
      }

      public static List<Vector3d> GetPerpendicular(Polyline polyline, bool unitize)
      {
        Polyline ccwAlign = AlignPolyline(polyline);
        List<Point3d> tempVertex = new List<Point3d>(ccwAlign);
        tempVertex.RemoveAt(tempVertex.Count() - 1);
        List<Vector3d> perpVector = new List<Vector3d>();
        int numVertex = tempVertex.Count;
        for (int i = 0; i < numVertex; i++)
        {
          Point3d tempStart = tempVertex[i];
          Point3d tempEnd = tempVertex[(numVertex + i + 1) % numVertex];
          Vector3d tempVector = new Vector3d(tempEnd - tempStart); // Align Vector with length
          tempVector.Transform(Transform.Rotation(Math.PI / 2, tempStart));

          if (unitize)
            tempVector = tempVector / tempVector.Length;

          perpVector.Add(tempVector);
        }
        return perpVector;
      }
    }

    /// <summary>
    /// Offset 대상인 폴리라인의 벡터를 이용해 Offset된 폴리라인의 내부 고리를 없애줍니다.
    /// </summary>
    public static List<Curve> RemoveLoop(Polyline loopedPoly, Polyline baseBound, double tolerance)
    {
      Curve loopedCrv = loopedPoly.ToNurbsCurve();
      Curve boundCrv = baseBound.ToNurbsCurve();
      var tempX = Rhino.Geometry.Intersect.Intersection.CurveSelf(loopedCrv, 0);

      List<double> splitParam = new List<double>();
      foreach (var i in tempX)
      {
        splitParam.Add(i.ParameterA);
        splitParam.Add(i.ParameterB);
      }

      List<Curve> splittedSegment = loopedCrv.Split(splitParam).ToList();
      List<Curve> loopOut = new List<Curve>();

      foreach (Curve i in splittedSegment)
      {
        List<Curve> testCrvSet = i.DuplicateSegments().ToList();

        if (testCrvSet.Count == 0)
          testCrvSet.Add(i);

        foreach (Curve j in testCrvSet)
        {
          Vector3d testVec = new Vector3d(j.PointAtEnd - j.PointAtStart);
          Point3d testBase = new Point3d((j.PointAtStart + j.PointAtEnd) / 2);
          testVec.Transform(Transform.Scale(j.PointAtStart, 1 / testVec.Length));
          testVec.Transform(Transform.Rotation(Math.PI / 2, j.PointAtStart));
          Point3d testPt = new Point3d(testBase + testVec * tolerance);

          int decider = (int) loopedCrv.Contains(testPt, Plane.WorldXY, tolerance / 2);
          int decider2 = (int) boundCrv.Contains(testPt, Plane.WorldXY, tolerance / 2);

          if ((decider != 2) && (decider2 != 2))
            loopOut.Add(j);
        }
      }

      List<Curve> joined = Curve.JoinCurves(loopOut).ToList();
      List<Curve> final = new List<Curve>();
      foreach (Curve k in joined)
      {
        Boolean decider3 = k.IsClosed;
        if (decider3 == true)
          final.Add(k);
      }

      return final;
    }

    /// <summary>
    /// 폴리라인의 각 변마다 거리를 지정해 Offset 커브를 만들어줍니다.
    /// </summary>
    public static List<Curve> ImprovedOffset(Polyline bound, List<double> offsetDist)
    {
      Polyline ccwBound = AlignPolyline(bound);
      List<Point3d> trimmedOffsetPt = new List<Point3d>();

      //set vectors
      List<Vector3d> alignVector = SegmentVector.GetAlign(ccwBound, true);
      List<Vector3d> perpVector = SegmentVector.GetPerpendicular(ccwBound, true);
      List<Point3d> boundVertex = GetVertex(ccwBound);

      int numSegment = alignVector.Count;
      int numVertex = boundVertex.Count;


      //offset and trim segments
      for (int i = 0; i < numSegment; i++)
      {
        double a = offsetDist[i];
        double b = offsetDist[(i + 1) % offsetDist.Count];
        double dotProduct = Vector3d.Multiply(alignVector[i], alignVector[(i + 1) % numSegment]);
        Vector3d crossProduct = Vector3d.CrossProduct(alignVector[i], alignVector[(i + 1) % numSegment]);
        double cos = Math.Abs(dotProduct / (alignVector[i].Length * alignVector[(i + 1) % numSegment].Length));
        double sin = Math.Sqrt(1 - Math.Pow(cos, 2));

        double decider1 = Vector3d.Multiply(Plane.WorldXY.ZAxis, crossProduct);
        double decider2 = Vector3d.Multiply(-alignVector[i], alignVector[(i + 1) % numSegment]);

        Point3d tempPt = new Point3d();

        if (decider1 > 0) // concave
        {
          if (decider2 < 0) // blunt
            tempPt = boundVertex[(i + 1) % numVertex] + perpVector[i] * a + alignVector[i] * ((a * cos - b) / sin);
          else // acute (right angle included)
            tempPt = boundVertex[(i + 1) % numVertex] + perpVector[i] * a + alignVector[i] * ((-a * cos - b) / sin);
        }

        else if (decider1 < 0) // convex
        {
          if (decider2 < 0) //blunt
            tempPt = boundVertex[(i + 1) % numVertex] + perpVector[i] * a + alignVector[i] * ((-a * cos + b) / sin);
          else // acute (right angle included)
            tempPt = boundVertex[(i + 1) % numVertex] + perpVector[i] * a + alignVector[i] * ((a * cos + b) / sin);
        }

        else //straight
          tempPt = boundVertex[(i + 1) % numVertex] + perpVector[i] * Math.Max(a, b);

        trimmedOffsetPt.Add(tempPt);
      }

      trimmedOffsetPt.Add(trimmedOffsetPt[0]);
      Polyline offBound = new Polyline(trimmedOffsetPt);

      //remove loop
      //List<Curve> loopOut = RemoveLoop(offBound, ccwBound, 0.001);
      //return loopOut;

      List<Curve> debug = new List<Curve>();
      debug.Add(offBound.ToNurbsCurve());
      return debug;
    }

  }

  class CurveTools
  {
    public static double GetArea(Curve input)
    {
      Polyline plotPolyline;
      input.TryGetPolyline(out plotPolyline);

      List<Point3d> y = new List<Point3d>(plotPolyline);
      double area = 0;

      for (int i = 0; i < y.Count - 1; i++)
      {
        area += y[i].X * y[i + 1].Y;
        area -= y[i].Y * y[i + 1].X;
      }

      area /= 2;
      return (area < 0 ? -area : area);
    }

    public static Polyline ToPolyline(Curve curve)
    {
      Polyline output = new Polyline();
      curve.TryGetPolyline(out output);
      return output;
    }

  }

  class NumberTools
  {
    public static double SumDouble(List<double> doubleList)
    {
      double result = new double();

      foreach (double i in doubleList)
        result += i;

      return result;
    }

  }

  class PCXTools
  {
    public static Line ExtendFromPt(Point3d basePt, Polyline boundary, Vector3d direction)
    {
      Line output = new Line();

      double coverAllLength = new BoundingBox(boundary).Diagonal.Length * 2;
      LineCurve lay = new LineCurve(basePt, basePt + direction / direction.Length * coverAllLength);

      var layIntersection = Rhino.Geometry.Intersect.Intersection.CurveCurve(lay, boundary.ToNurbsCurve(), 0, 0);

      List<Point3d> intersectedPts = new List<Point3d>();
      foreach (var i in layIntersection)
        intersectedPts.Add(i.PointA);

      intersectedPts.Sort((x, y) => basePt.DistanceTo(x).CompareTo(basePt.DistanceTo(y)));
      output = new Line(basePt, intersectedPts[0]);

      return output;
    }
  }

  class CCXTools
  {
    public static Polyline RegionIntersect(Polyline polyline1, Polyline polyline2)
    {
      Polyline resultPolyine = new Polyline();

      List<double> tempParamA = new List<double>(); //Polyline1 위의 교차점
      List<double> tempParamB = new List<double>(); //Polyline1 위의 교차점
      Curve polyCurve1 = polyline1.ToNurbsCurve();
      Curve polyCurve2 = polyline2.ToNurbsCurve();

      List<Curve> tempLocalResult = new List<Curve>();

      var tempIntersection = Rhino.Geometry.Intersect.Intersection.CurveCurve(polyCurve1, polyCurve2, 0, 0);
      foreach (var i in tempIntersection)
      {
        tempParamA.Add(i.ParameterA);
        tempParamB.Add(i.ParameterB);
      }

      List<Curve> tempSplittedA = polyCurve1.Split(tempParamA).ToList();
      List<Curve> tempSplittedB = polyCurve2.Split(tempParamB).ToList();

      //case of Polyline1
      foreach (Curve i in tempSplittedA)
      {
        List<Curve> testCrvSet = i.DuplicateSegments().ToList();

        if (testCrvSet.Count == 0)
          testCrvSet.Add(i);

        foreach (Curve j in testCrvSet)
        {
          Point3d testPt = new Point3d((j.PointAtEnd + j.PointAtStart) / 2);
          int decider = (int) polyCurve2.Contains(testPt);

          if (decider != 2)
            tempLocalResult.Add(j);
        }
      }

      //case of Polyline2
      foreach (Curve i in tempSplittedB)
      {
        List<Curve> testCrvSet = i.DuplicateSegments().ToList();

        if (testCrvSet.Count == 0)
          testCrvSet.Add(i);

        foreach (Curve j in testCrvSet)
        {
          Point3d testPt = new Point3d((j.PointAtEnd + j.PointAtStart) / 2);
          int decider = (int) polyCurve1.Contains(testPt);

          if (decider != 2)
            tempLocalResult.Add(j);
        }
      }
      List<Curve> resultList = Curve.JoinCurves(tempLocalResult).ToList();
      resultList.OrderByDescending(i => CurveTools.GetArea(i));

      if (resultList.Count != 0)
        resultPolyine = CurveTools.ToPolyline(resultList[0]);

      return resultPolyine;
    }

    public static List<Curve> RegionIntersect(List<Curve> curveSet1, List<Curve> curveSet2)
    {
      List<Curve> IntersectCrvs = new List<Curve>();
      foreach (Curve i in curveSet1)
      {
        foreach (Curve j in curveSet2)
        {
          List<double> tempParamA = new List<double>();
          List<double> tempParamB = new List<double>();
          List<Curve> tempLocalResult = new List<Curve>();

          var tempIntersection = Rhino.Geometry.Intersect.Intersection.CurveCurve(i, j, 0, 0);
          foreach (var k in tempIntersection)
          {
            tempParamA.Add(k.ParameterA);
            tempParamB.Add(k.ParameterB);
          }

          List<Curve> tempSplittedA = i.Split(tempParamA).ToList();
          List<Curve> tempSplittedB = j.Split(tempParamB).ToList();

          //case of Curve1
          foreach (Curve k in tempSplittedA)
          {
            List<Curve> testCrvSet = k.DuplicateSegments().ToList();

            if (testCrvSet.Count == 0)
              testCrvSet.Add(k);

            foreach (Curve l in testCrvSet)
            {
              Point3d testPt = new Point3d((l.PointAtEnd + l.PointAtStart) / 2);
              int decider = (int) j.Contains(testPt);

              if (decider != 2)
                tempLocalResult.Add(l);
            }
          }

          //case of Curve2
          foreach (Curve k in tempSplittedB)
          {
            List<Curve> testCrvSet = k.DuplicateSegments().ToList();

            if (testCrvSet.Count == 0)
              testCrvSet.Add(k);

            foreach (Curve l in testCrvSet)
            {
              Point3d testPt = new Point3d((l.PointAtEnd + l.PointAtStart) / 2);
              int decider = (int) i.Contains(testPt);

              if (decider != 2)
                tempLocalResult.Add(l);
            }
          }
          IntersectCrvs.AddRange(Curve.JoinCurves(tempLocalResult).ToList());
        }
      }
      return IntersectCrvs;
    }
  }
# ---------- end pattern3 ----------
panel_6 = Panel(pattern3.out)
crv_22 = Curve(pattern3.C)
pt_3 = Point(pattern3.B)
pt_4 = Point(pattern3.A)
azure_4 = ColourRGB(Alpha=255, Red=67, Green=156, Blue=210)
coral_2 = ColourRGB(Alpha=255, Red=176, Green=52, Blue=49)
preview_8 = CustomPreview(Geometry=crv_22, Shader=azure_4)
preview_9 = CustomPreview(Geometry=[pt_4, pt_3], Shader=coral_2)

crv_23 = Curve(<curve referenced from the Rhino model>)
crv_24 = Curve(<curve referenced from the Rhino model>)
crv_25 = Curve(<curve referenced from the Rhino model>)
c_script_6 = CSharpScript(x=crv_24)  # -> out, A; inputs x: Polyline; same code as c_script_5
pattern4 = CSharpScript(
    outline=crv_23,
    coreLine=crv_24,
    landing=crv_25,
    upstairDirec=c_script_6.A,
    a1HFactor=Slider(0.22, range=0.001..1),
    a2VFactor=Slider(1, range=0.001..1))  # -> out, A, B, C, D; inputs outline: Polyline, coreLine: Polyline, landing: Polyline, upstairDirec: Vector3d, a1HFactor: Double, a2VFactor: Double
# ---------- pattern4: C# ----------
    Line baseLine = SearchBaseLine(landing, upstairDirec);
    List<Line> baseAxis = SetBaseAxis(landing, outline, upstairDirec, baseLine);
    double subLength = new double();

    Point3d anchor1 = DrawAnchor1(outline, coreLine, upstairDirec, baseLine, baseAxis, 1800, 1, out subLength);
    Point3d anchor2 = DrawAnchor2(anchor1, outline, upstairDirec, baseLine, baseAxis, a1HFactor, 1800, 1);
    Point3d anchor3 = DrawAnchor3(anchor2, outline, baseAxis, a2VFactor, subLength);

    List<Point3d> anchors = new List<Point3d>();
    anchors.Add(anchor1);
    anchors.Add(anchor2);
    anchors.Add(anchor3);

    Polyline corridor = DrawCorridor(anchors, baseAxis, 1800, subLength, 1);

    A = anchor1;
    B = anchor2;
    C = anchor3;
    D = corridor;
# ---------- pattern4: C# additional code ----------
  public Line SearchBaseLine(Polyline landing, Vector3d upstairDirec)
  {
    //output
    Line baseSeg = new Line();

    //process
    List<Line> landingSeg = landing.GetSegments().ToList();
    List<Line> perpToStair = new List<Line>();

    double perpTolerance = 0.005;

    foreach (Line i in landingSeg)
    {
      double axisDecider = Math.Abs(Vector3d.Multiply(i.Direction, upstairDirec));
      if (axisDecider < perpTolerance)
        perpToStair.Add(i);
    }

    perpToStair.Sort(delegate (Line x, Line y)
      {
        Point3d perp1Center = x.PointAt(0.5);
        Point3d perp2Center = y.PointAt(0.5);

        Vector3d gapBetween = perp1Center - perp2Center;
        double decider = Vector3d.Multiply(gapBetween, upstairDirec);

        if (decider > 0)
          return -1;
        else if (decider == 0)
          return 0;
        else
          return 1;
      });

    baseSeg = perpToStair[0];

    return baseSeg;
  }

  public double SetBasePtVLimit(Polyline landing, Vector3d upstairDirec, Line baseLine)
  {
    double vLimit = 0;

    Point3d decidingPt1 = baseLine.PointAt(0.01) - upstairDirec / upstairDirec.Length * 0.01;
    Point3d decidingPt2 = baseLine.PointAt(0.09) - upstairDirec / upstairDirec.Length * 0.01;

    double candidate1 = PCXTools.ExtendFromPt(decidingPt1, landing, -upstairDirec).Length + 0.01;
    double candidate2 = PCXTools.ExtendFromPt(decidingPt2, landing, -upstairDirec).Length + 0.01;

    if (candidate1 > candidate2)
      vLimit = candidate2;
    else
      vLimit = candidate1;

    return vLimit;
  }

  public List<Line> SetBaseAxis(Polyline landing, Polyline outline, Vector3d upstairDirec, Line baseLine)
  {
    //output
    List<Line> mainAxis = new List<Line>();

    //process
    double basePtH = SetBasePtVLimit(landing, upstairDirec, baseLine);
    Point3d basePt = baseLine.PointAt(0.5) - (upstairDirec / upstairDirec.Length) * SetBasePtVLimit(landing, upstairDirec, baseLine) / 2;

    //set horizontalAxis, 횡축은 외곽선에서 더 먼 쪽을 선택
    Line horizonReached1 = PCXTools.ExtendFromPt(basePt, outline, baseLine.UnitTangent);
    Line horizonReached2 = PCXTools.ExtendFromPt(basePt, outline, -baseLine.UnitTangent);

    if (horizonReached1.Length > horizonReached2.Length)
      mainAxis.Add(horizonReached1);
    else
      mainAxis.Add(horizonReached2);

    //set verticalAxis, 종축은 외곽선에서 더 가까운 쪽을 선택
    Line verticalReached1 = PCXTools.ExtendFromPt(basePt, outline, upstairDirec);
    Line verticalReached2 = PCXTools.ExtendFromPt(basePt, outline, -upstairDirec);

    if (verticalReached1.Length < verticalReached2.Length)
      mainAxis.Add(verticalReached1);
    else
      mainAxis.Add(verticalReached2);

    return mainAxis;

  }

  public Point3d DrawAnchor1(Polyline outline, Polyline coreLine, Vector3d upstairDirec, Line baseLine, List<Line> baseAxis, double corridorWidth, double scale, out double subLength)
  {
    Point3d anchor1 = new Point3d();

    Point3d anchorBase = baseAxis[0].PointAt(0);

    double coreSideLength = PCXTools.ExtendFromPt(anchorBase, coreLine, -baseAxis[1].UnitTangent).Length;
    double landingSideLength = baseLine.PointAt(0.5).DistanceTo(anchorBase);
    double subCorridorWidth = coreSideLength + landingSideLength;
    double scaledCorridorWidth = corridorWidth / scale;
    double halfHLength = baseLine.Length / 2;

    Vector3d hAxis = baseAxis[0].UnitTangent;
    Vector3d vAxis = -baseAxis[1].UnitTangent;


    anchor1 = anchorBase + vAxis * (subCorridorWidth / 2 - landingSideLength) + hAxis * (halfHLength + scaledCorridorWidth / 2);

    subLength = subCorridorWidth;
    return anchor1;
  }

  public Point3d DrawAnchor2(Point3d anchor1, Polyline outline, Vector3d upstairDirec, Line baseLine, List<Line> baseAxis, double hFactor, double corridorWidth, double scale)
  {
    //output
    Point3d anchor2 = new Point3d();

    //base setting
    double minChamberWidth = 3000 / scale; //최소 방 너비 //scale하고 같이 따로 static으로 만들어 둘것 --;
    double scaledCorridorwidth = corridorWidth / scale;
    double baseHalfVSize = baseLine.PointAt(0.5).DistanceTo(baseAxis[0].PointAt(0));
    double baseHalfHSize = baseLine.Length / 2;

    //set horizontal limit
    List<double> limitCandidates = new List<double>();

    limitCandidates.Add(0);
    limitCandidates.Add(baseAxis[0].Length - scaledCorridorwidth - baseHalfHSize);

    double shortHAxisLength = PCXTools.ExtendFromPt(baseLine.PointAt(0.5), outline, -baseAxis[0].UnitTangent).Length;
    limitCandidates.Add(minChamberWidth - shortHAxisLength);

    limitCandidates.Sort((x, y) => -x.CompareTo(y));

    double limitUpper = limitCandidates[0];
    double limitLower = limitCandidates[1];

    double hLimit = limitUpper - limitLower;

    //set vertical limit

    //draw anchors
    Vector3d hAxis = baseAxis[0].UnitTangent;

    anchor2 = anchor1 + hAxis * (hLimit * hFactor + limitLower);
    return anchor2;
  }

  public Point3d DrawAnchor3(Point3d anchor2, Polyline outline, List<Line> baseAxis, double vFactor, double subLength)
  {
    Point3d anchor3 = new Point3d();
    Point3d anchorBase = baseAxis[0].PointAt(0);

    double vLimit = PCXTools.ExtendFromPt(anchor2, outline, -baseAxis[1].UnitTangent).Length - subLength / 2;
    anchor3 = anchor2 - baseAxis[1].UnitTangent * (vLimit * vFactor);

    return anchor3;
  }

  public Polyline DrawCorridor(List<Point3d> anchors, List<Line> baseAxis, double corridorWidth, double subLength, double scale)
  {
    Polyline corridor = new Polyline();

    Rectangle3d subCorridor = RectangleTools.DrawP2PRect(anchors[0], anchors[1], subLength, corridorWidth / scale);
    Rectangle3d mainCorridor = RectangleTools.DrawP2PRect(anchors[1], anchors[2], corridorWidth / scale, subLength);

    List<Curve> forUnion = new List<Curve>();
    forUnion.Add(subCorridor.ToNurbsCurve());
    forUnion.Add(mainCorridor.ToNurbsCurve());

    corridor = CurveTools.ToPolyline(Curve.CreateBooleanUnion(forUnion)[0]);

    return corridor;
  }

  class VectorTools
  {
    public static Vector3d RotateVectorXY(Vector3d baseVector, double angle)
    {
      Vector3d rotatedVector = new Vector3d(baseVector.X * Math.Cos(angle) - baseVector.Y * Math.Sin(angle), baseVector.X * Math.Sin(angle) + baseVector.Y * Math.Cos(angle), 0);
      return rotatedVector;
    }
  }

  class RectangleTools
  {
    public static Rectangle3d DrawP2PRect(Point3d pointStart, Point3d pointEnd, double thickness)
    {
      Rectangle3d p2pRect = new Rectangle3d();

      Vector3d alignP2P = new Line(pointStart, pointEnd).UnitTangent;
      Vector3d perpP2P = VectorTools.RotateVectorXY(alignP2P, Math.PI / 2);

      Point3d corner1 = pointStart - alignP2P * thickness / 2 + perpP2P * thickness / 2;
      Point3d corner2 = pointEnd + alignP2P * thickness / 2 - perpP2P * thickness / 2;
      Plane p2pPlane = new Plane(pointStart, alignP2P, perpP2P);

      p2pRect = new Rectangle3d(p2pPlane, corner1, corner2);

      return p2pRect;
    }
    
    public static Rectangle3d DrawP2PRect(Point3d pointStart, Point3d pointEnd, double perpThickness, double alignThickness)
    {
      Rectangle3d p2pRect = new Rectangle3d();

      Vector3d alignP2P = new Line(pointStart, pointEnd).UnitTangent;
      Vector3d perpP2P = VectorTools.RotateVectorXY(alignP2P, Math.PI / 2);

      Point3d corner1 = pointStart - alignP2P * alignThickness / 2 + perpP2P * perpThickness / 2;
      Point3d corner2 = pointEnd + alignP2P * alignThickness / 2 - perpP2P * perpThickness / 2;
      Plane p2pPlane = new Plane(pointStart, alignP2P, perpP2P);

      p2pRect = new Rectangle3d(p2pPlane, corner1, corner2);

      return p2pRect;
    }
  }

  class PolylineTools
  {
    public static double GetArea(Polyline input)
    {
      List<Point3d> y = new List<Point3d>(input);
      double area = 0;

      for (int i = 0; i < y.Count - 1; i++)
      {
        area += y[i].X * y[i + 1].Y;
        area -= y[i].Y * y[i + 1].X;
      }

      area /= 2;
      return (area < 0 ? -area : area);
    }

    /// <summary>
    /// 닫힌 폴리라인 방향을 반시계 방향으로 만들어줍니다. (꼭지점의 index 순서 기준)
    /// </summary>
    public static Polyline AlignPolyline(Polyline polyline)
    {
      Polyline output = new Polyline(polyline);
      if (output.ToNurbsCurve().ClosedCurveOrientation(Vector3d.ZAxis) == CurveOrientation.CounterClockwise)
      {
        output.Reverse();
      }
      return output;
    }

    public static List<Point3d> GetVertex(Polyline polyline)
    {
      List<Point3d> tempVertex = new List<Point3d>(polyline);
      tempVertex.RemoveAt(tempVertex.Count - 1);

      return tempVertex;
    }

    /// <summary>
    /// 폴리라인의 각 세그먼트들에 대해 평행한 또는 안쪽으로 수직인 벡터 리스트를 구해줍니다.(반시계방향 기준)
    /// </summary>
    public class SegmentVector
    {
      public static List<Vector3d> GetAlign(Polyline polyline, bool unitize)
      {
        Polyline ccwAlign = AlignPolyline(polyline);
        List<Point3d> tempVertex = new List<Point3d>(ccwAlign);
        tempVertex.RemoveAt(tempVertex.Count() - 1);
        List<Vector3d> alignVector = new List<Vector3d>();
        int numVertex = tempVertex.Count;
        for (int i = 0; i < numVertex; i++)
        {
          Point3d tempStart = tempVertex[i];
          Point3d tempEnd = tempVertex[(numVertex + i + 1) % numVertex];
          Vector3d tempVector = new Vector3d(tempEnd - tempStart); // Align Vector with length

          if (unitize)
            tempVector = tempVector / tempVector.Length;

          alignVector.Add(tempVector);
        }
        return alignVector;
      }

      public static List<Vector3d> GetPerpendicular(Polyline polyline, bool unitize)
      {
        Polyline ccwAlign = AlignPolyline(polyline);
        List<Point3d> tempVertex = new List<Point3d>(ccwAlign);
        tempVertex.RemoveAt(tempVertex.Count() - 1);
        List<Vector3d> perpVector = new List<Vector3d>();
        int numVertex = tempVertex.Count;
        for (int i = 0; i < numVertex; i++)
        {
          Point3d tempStart = tempVertex[i];
          Point3d tempEnd = tempVertex[(numVertex + i + 1) % numVertex];
          Vector3d tempVector = new Vector3d(tempEnd - tempStart); // Align Vector with length
          tempVector.Transform(Transform.Rotation(Math.PI / 2, tempStart));

          if (unitize)
            tempVector = tempVector / tempVector.Length;

          perpVector.Add(tempVector);
        }
        return perpVector;
      }
    }

    /// <summary>
    /// Offset 대상인 폴리라인의 벡터를 이용해 Offset된 폴리라인의 내부 고리를 없애줍니다.
    /// </summary>
    public static List<Curve> RemoveLoop(Polyline loopedPoly, Polyline baseBound, double tolerance)
    {
      Curve loopedCrv = loopedPoly.ToNurbsCurve();
      Curve boundCrv = baseBound.ToNurbsCurve();
      var tempX = Rhino.Geometry.Intersect.Intersection.CurveSelf(loopedCrv, 0);

      List<double> splitParam = new List<double>();
      foreach (var i in tempX)
      {
        splitParam.Add(i.ParameterA);
        splitParam.Add(i.ParameterB);
      }

      List<Curve> splittedSegment = loopedCrv.Split(splitParam).ToList();
      List<Curve> loopOut = new List<Curve>();

      foreach (Curve i in splittedSegment)
      {
        List<Curve> testCrvSet = i.DuplicateSegments().ToList();

        if (testCrvSet.Count == 0)
          testCrvSet.Add(i);

        foreach (Curve j in testCrvSet)
        {
          Vector3d testVec = new Vector3d(j.PointAtEnd - j.PointAtStart);
          Point3d testBase = new Point3d((j.PointAtStart + j.PointAtEnd) / 2);
          testVec.Transform(Transform.Scale(j.PointAtStart, 1 / testVec.Length));
          testVec.Transform(Transform.Rotation(Math.PI / 2, j.PointAtStart));
          Point3d testPt = new Point3d(testBase + testVec * tolerance);

          int decider = (int) loopedCrv.Contains(testPt, Plane.WorldXY, tolerance / 2);
          int decider2 = (int) boundCrv.Contains(testPt, Plane.WorldXY, tolerance / 2);

          if ((decider != 2) && (decider2 != 2))
            loopOut.Add(j);
        }
      }

      List<Curve> joined = Curve.JoinCurves(loopOut).ToList();
      List<Curve> final = new List<Curve>();
      foreach (Curve k in joined)
      {
        Boolean decider3 = k.IsClosed;
        if (decider3 == true)
          final.Add(k);
      }

      return final;
    }

    /// <summary>
    /// 폴리라인의 각 변마다 거리를 지정해 Offset 커브를 만들어줍니다.
    /// </summary>
    public static List<Curve> ImprovedOffset(Polyline bound, List<double> offsetDist)
    {
      Polyline ccwBound = AlignPolyline(bound);
      List<Point3d> trimmedOffsetPt = new List<Point3d>();

      //set vectors
      List<Vector3d> alignVector = SegmentVector.GetAlign(ccwBound, true);
      List<Vector3d> perpVector = SegmentVector.GetPerpendicular(ccwBound, true);
      List<Point3d> boundVertex = GetVertex(ccwBound);

      int numSegment = alignVector.Count;
      int numVertex = boundVertex.Count;


      //offset and trim segments
      for (int i = 0; i < numSegment; i++)
      {
        double a = offsetDist[i];
        double b = offsetDist[(i + 1) % offsetDist.Count];
        double dotProduct = Vector3d.Multiply(alignVector[i], alignVector[(i + 1) % numSegment]);
        Vector3d crossProduct = Vector3d.CrossProduct(alignVector[i], alignVector[(i + 1) % numSegment]);
        double cos = Math.Abs(dotProduct / (alignVector[i].Length * alignVector[(i + 1) % numSegment].Length));
        double sin = Math.Sqrt(1 - Math.Pow(cos, 2));

        double decider1 = Vector3d.Multiply(Plane.WorldXY.ZAxis, crossProduct);
        double decider2 = Vector3d.Multiply(-alignVector[i], alignVector[(i + 1) % numSegment]);

        Point3d tempPt = new Point3d();

        if (decider1 > 0) // concave
        {
          if (decider2 < 0) // blunt
            tempPt = boundVertex[(i + 1) % numVertex] + perpVector[i] * a + alignVector[i] * ((a * cos - b) / sin);
          else // acute (right angle included)
            tempPt = boundVertex[(i + 1) % numVertex] + perpVector[i] * a + alignVector[i] * ((-a * cos - b) / sin);
        }

        else if (decider1 < 0) // convex
        {
          if (decider2 < 0) //blunt
            tempPt = boundVertex[(i + 1) % numVertex] + perpVector[i] * a + alignVector[i] * ((-a * cos + b) / sin);
          else // acute (right angle included)
            tempPt = boundVertex[(i + 1) % numVertex] + perpVector[i] * a + alignVector[i] * ((a * cos + b) / sin);
        }

        else //straight
          tempPt = boundVertex[(i + 1) % numVertex] + perpVector[i] * Math.Max(a, b);

        trimmedOffsetPt.Add(tempPt);
      }

      trimmedOffsetPt.Add(trimmedOffsetPt[0]);
      Polyline offBound = new Polyline(trimmedOffsetPt);

      //remove loop
      //List<Curve> loopOut = RemoveLoop(offBound, ccwBound, 0.001);
      //return loopOut;

      List<Curve> debug = new List<Curve>();
      debug.Add(offBound.ToNurbsCurve());
      return debug;
    }

  }

  class CurveTools
  {
    public static double GetArea(Curve input)
    {
      Polyline plotPolyline;
      input.TryGetPolyline(out plotPolyline);

      List<Point3d> y = new List<Point3d>(plotPolyline);
      double area = 0;

      for (int i = 0; i < y.Count - 1; i++)
      {
        area += y[i].X * y[i + 1].Y;
        area -= y[i].Y * y[i + 1].X;
      }

      area /= 2;
      return (area < 0 ? -area : area);
    }

    public static Polyline ToPolyline(Curve curve)
    {
      Polyline output = new Polyline();
      curve.TryGetPolyline(out output);
      return output;
    }

  }

  class NumberTools
  {
    public static double SumDouble(List<double> doubleList)
    {
      double result = new double();

      foreach (double i in doubleList)
        result += i;

      return result;
    }

  }

  class PCXTools
  {
    public static Line ExtendFromPt(Point3d basePt, Polyline boundary, Vector3d direction)
    {
      Line output = new Line();

      double coverAllLength = new BoundingBox(boundary).Diagonal.Length * 2;
      LineCurve lay = new LineCurve(basePt, basePt + direction / direction.Length * coverAllLength);

      var layIntersection = Rhino.Geometry.Intersect.Intersection.CurveCurve(lay, boundary.ToNurbsCurve(), 0, 0);

      List<Point3d> intersectedPts = new List<Point3d>();
      foreach (var i in layIntersection)
        intersectedPts.Add(i.PointA);

      intersectedPts.Sort((x, y) => basePt.DistanceTo(x).CompareTo(basePt.DistanceTo(y)));
      output = new Line(basePt, intersectedPts[0]);

      return output;
    }
  }

  class CCXTools
  {
    public static Polyline RegionIntersect(Polyline polyline1, Polyline polyline2)
    {
      Polyline resultPolyine = new Polyline();

      List<double> tempParamA = new List<double>(); //Polyline1 위의 교차점
      List<double> tempParamB = new List<double>(); //Polyline1 위의 교차점
      Curve polyCurve1 = polyline1.ToNurbsCurve();
      Curve polyCurve2 = polyline2.ToNurbsCurve();

      List<Curve> tempLocalResult = new List<Curve>();

      var tempIntersection = Rhino.Geometry.Intersect.Intersection.CurveCurve(polyCurve1, polyCurve2, 0, 0);
      foreach (var i in tempIntersection)
      {
        tempParamA.Add(i.ParameterA);
        tempParamB.Add(i.ParameterB);
      }

      List<Curve> tempSplittedA = polyCurve1.Split(tempParamA).ToList();
      List<Curve> tempSplittedB = polyCurve2.Split(tempParamB).ToList();

      //case of Polyline1
      foreach (Curve i in tempSplittedA)
      {
        List<Curve> testCrvSet = i.DuplicateSegments().ToList();

        if (testCrvSet.Count == 0)
          testCrvSet.Add(i);

        foreach (Curve j in testCrvSet)
        {
          Point3d testPt = new Point3d((j.PointAtEnd + j.PointAtStart) / 2);
          int decider = (int) polyCurve2.Contains(testPt);

          if (decider != 2)
            tempLocalResult.Add(j);
        }
      }

      //case of Polyline2
      foreach (Curve i in tempSplittedB)
      {
        List<Curve> testCrvSet = i.DuplicateSegments().ToList();

        if (testCrvSet.Count == 0)
          testCrvSet.Add(i);

        foreach (Curve j in testCrvSet)
        {
          Point3d testPt = new Point3d((j.PointAtEnd + j.PointAtStart) / 2);
          int decider = (int) polyCurve1.Contains(testPt);

          if (decider != 2)
            tempLocalResult.Add(j);
        }
      }
      List<Curve> resultList = Curve.JoinCurves(tempLocalResult).ToList();
      resultList.OrderByDescending(i => CurveTools.GetArea(i));

      if (resultList.Count != 0)
        resultPolyine = CurveTools.ToPolyline(resultList[0]);

      return resultPolyine;
    }

    public static List<Curve> RegionIntersect(List<Curve> curveSet1, List<Curve> curveSet2)
    {
      List<Curve> IntersectCrvs = new List<Curve>();
      foreach (Curve i in curveSet1)
      {
        foreach (Curve j in curveSet2)
        {
          List<double> tempParamA = new List<double>();
          List<double> tempParamB = new List<double>();
          List<Curve> tempLocalResult = new List<Curve>();

          var tempIntersection = Rhino.Geometry.Intersect.Intersection.CurveCurve(i, j, 0, 0);
          foreach (var k in tempIntersection)
          {
            tempParamA.Add(k.ParameterA);
            tempParamB.Add(k.ParameterB);
          }

          List<Curve> tempSplittedA = i.Split(tempParamA).ToList();
          List<Curve> tempSplittedB = j.Split(tempParamB).ToList();

          //case of Curve1
          foreach (Curve k in tempSplittedA)
          {
            List<Curve> testCrvSet = k.DuplicateSegments().ToList();

            if (testCrvSet.Count == 0)
              testCrvSet.Add(k);

            foreach (Curve l in testCrvSet)
            {
              Point3d testPt = new Point3d((l.PointAtEnd + l.PointAtStart) / 2);
              int decider = (int) j.Contains(testPt);

              if (decider != 2)
                tempLocalResult.Add(l);
            }
          }

          //case of Curve2
          foreach (Curve k in tempSplittedB)
          {
            List<Curve> testCrvSet = k.DuplicateSegments().ToList();

            if (testCrvSet.Count == 0)
              testCrvSet.Add(k);

            foreach (Curve l in testCrvSet)
            {
              Point3d testPt = new Point3d((l.PointAtEnd + l.PointAtStart) / 2);
              int decider = (int) i.Contains(testPt);

              if (decider != 2)
                tempLocalResult.Add(l);
            }
          }
          IntersectCrvs.AddRange(Curve.JoinCurves(tempLocalResult).ToList());
        }
      }
      return IntersectCrvs;
    }
  }
# ---------- end pattern4 ----------
crv_26 = Curve(pattern4.D)
pt_5 = Point(pattern4.A)
pt_6 = Point(pattern4.B)
pt_7 = Point(pattern4.C)
panel_7 = Panel(pattern4.out)
azure_5 = ColourRGB(Alpha=255, Red=67, Green=156, Blue=210)
coral_3 = ColourRGB(Alpha=255, Red=176, Green=52, Blue=49)
preview_10 = CustomPreview(Geometry=crv_26, Shader=azure_5)
preview_11 = CustomPreview(Geometry=[pt_5, pt_6, pt_7], Shader=coral_3)

c_script_7 = CSharpScript()  # -> out, A
# ---------- c_script_7: C# ----------
    List<double> test = new List<double>{30,60,75,30};
    List<double> test1 = GetProportion(test, 2);

    A = test1;
# ---------- c_script_7: C# additional code ----------
  public static List<double> GetProportion(List<double> doubleList, int decimals)
  {
    List<double> proportions = new List<double>();

    double sum = SumDouble(doubleList);
    foreach (double i in doubleList)
      proportions.Add(Math.Round((i / sum) * 100, decimals));

    return proportions;
  }

  public static double SumDouble(List<double> doubleList)
  {
    double result = new double();

    foreach (double i in doubleList)
      result += i;

    return result;
  }
# ---------- end c_script_7 ----------
panel_8 = Panel(c_script_7.A)
panel_9 = Panel(c_script_7.out)
